# Dynamo graph importExcel.dyn (Dynamo 2.12.0.5650)

file_path = Filename("..\..\hecCalc\Final\02_팀 표준 Family List_Rev.0_2022_0215.xlsx")
code_block = CodeBlock { "1.Floor"; }
full_data = Python(IN[0]=file_path, IN[1]=code_block)  # CPython3
# ---------- full_data.python (75 lines) ----------
# Load the Python Standard and DesignScript Libraries
import os
python_rootpath = os.getenv('LOCALAPPDATA')+'\Programs\Python'
file_list = os.listdir(python_rootpath)
python_version = file_list[-1]
import sys
sys.path.append(os.getenv('LOCALAPPDATA').replace('\\','\\\\') + f'\Programs\Python\{python_version}\Lib\site-packages')
import clr


clr.AddReference('ProtoGeometry')
from Autodesk.DesignScript.Geometry import *

import random
import itertools
from functools import reduce
from collections import Iterable
import datetime
import openpyxl

# The inputs to this node will be stored as a list in the IN variables.
dataEnteringNode = IN
inputFilePath = IN[0]
inputSheetName = IN[1]

def importExcel(path, SheetNameIn):
    wb_obj = openpyxl.load_workbook(str(path), data_only=True)
    sheet_obj = wb_obj.get_sheet_by_name(str(SheetNameIn))

    m_row = sheet_obj.max_row
    m_col = sheet_obj.max_column

    listOut = []

    for i in range(1, m_row +1):
        listTemp = []
        for j in range(1, m_col + 1):
            cell_obj = sheet_obj.cell(row=i, column=j)
            listTemp.append(cell_obj.value)
            if len(listTemp) == m_col:
                listOut.append(listTemp)
    return listOut

def checkAllElement(list, target):
    tmp=[]
    for i in list:
        if i == target:
            tmp.append(True)
        else:
            tmp.append(False)
    return all(tmp)


# Place your code below this line

result = importExcel(inputFilePath, inputSheetName)

for i in result:## null만 있는 Excel Row 제거
    if checkAllElement(i, None):
        result.remove(i)
    else:
        pass
        
result_tr = list(zip(*result))

for i in result_tr:## null만 있는 Excel Column 제거
    if checkAllElement(i, None):
        result_tr.remove(i)
    else:
        pass

result = list(zip(*result_tr))

# Assign your output to the OUT variable.
OUT = result
# ----------------------------------------
watch = Watch(full_data)
transpose = List.Transpose(lists=full_data)
watch_2 = Watch(transpose)
python_script = Python(IN[0]=full_data)  # CPython3
# ---------- python_script.python (50 lines) ----------
# Python 표준 및 DesignScript 라이브러리 로드
import sys
import clr
clr.AddReference('ProtoGeometry')
from Autodesk.DesignScript.Geometry import *

from itertools import chain
from functools import reduce

curry = lambda f: lambda a,*args: f(a, *args) if (len(args)) else lambda *args: f(a, *args)

add = curry(lambda a,b: a + b)

filter = curry(filter)
map = curry(map)

def _take(length, iter):
    res = []
    for a in iter:
        res.append(a)
        if len(res) == length:
            return res
take = curry(_take)
reduce = curry(reduce)
go = lambda *args: reduce(lambda a,f: f(a), args)
# 이 노드에 대한 입력값은 IN 변수에 리스트로 저장됩니다.
dataEnteringNode = IN

datas = IN[0]

# 코드를 이 선 아래에 배치
def chck_heads(row):
    def chck(a):
        try: 
            if "NO" in a: return True
            else: return False
        except: return False

    blns = lambda list: go(list,
        map(lambda a: chck(a)))
    return any(blns(row))
    

head = lambda list: go(list,
    filter(lambda a: chck_heads(a)),
    )
    
res = list(head(datas))[0]
# 출력을 OUT 변수에 지정합니다.
OUT = res
# ----------------------------------------
code_block_2 = CodeBlock()
# ---------- code_block_2.designscript (7 lines) ----------
//Out Cutting

//데이터 시작점 파악

//불필요 칼럼 제외

//[Family List] 식별
# ----------------------------------------
code_block_3 = CodeBlock()  # //전체가 Null 인것 제외
out_cuttng = Python(IN[0]=full_data)  # CPython3
# ---------- out_cuttng.python (61 lines) ----------
# Python 표준 및 DesignScript 라이브러리 로드
import sys
import clr
clr.AddReference('ProtoGeometry')
from Autodesk.DesignScript.Geometry import *

from itertools import chain
from functools import reduce

curry = lambda f: lambda a,*args: f(a, *args) if (len(args)) else lambda *args: f(a, *args)

add = curry(lambda a,b: a + b)

filter = curry(filter)
map = curry(map)

def _take(length, iter):
    res = []
    for a in iter:
        res.append(a)
        if len(res) == length:
            return res
take = curry(_take)
reduce = curry(reduce)
go = lambda *args: reduce(lambda a,f: f(a), args)
# 이 노드에 대한 입력값은 IN 변수에 리스트로 저장됩니다.
dataEnteringNode = IN

datas = IN[0]

# 코드를 이 선 아래에 배치
def vld(a):
    try: return a
    except: return ""
        
def findstartpt(datas):
    res = []    
    for i in enumerate(datas):
        for j in enumerate(i[1]):
            cell = vld(j[1])
            try:
                if "[" in cell or "]" in cell: ### 동작하려면 엑셀의 시트 제목이 []를 포함해야함
                    res.append((i[0],j[0]))
            except: pass

    return res[0]

startpt = findstartpt(datas)

def outcut(datas):
    s1 = datas[startpt[0]:]
    s2 = list(map(lambda a: a[startpt[1]:], s1))
    return s2

#head = lambda list: go(list,
#    filter(lambda a: chck_heads(a)),
#    )
    
result = outcut(datas)
# 출력을 OUT 변수에 지정합니다.
OUT = result
# ----------------------------------------
in_cuttng = Python(IN[0]=out_cuttng)  # CPython3
# ---------- in_cuttng.python (61 lines) ----------
# Python 표준 및 DesignScript 라이브러리 로드
import sys
import clr
clr.AddReference('ProtoGeometry')
from Autodesk.DesignScript.Geometry import *

from itertools import chain
from functools import reduce

curry = lambda f: lambda a,*args: f(a, *args) if (len(args)) else lambda *args: f(a, *args)

add = curry(lambda a,b: a + b)

filter = curry(filter)
map = curry(map)

def _take(length, iter):
    res = []
    for a in iter:
        res.append(a)
        if len(res) == length:
            return res
take = curry(_take)
reduce = curry(reduce)
go = lambda *args: reduce(lambda a,f: f(a), args)
# 이 노드에 대한 입력값은 IN 변수에 리스트로 저장됩니다.
dataEnteringNode = IN

datas = IN[0]

# 코드를 이 선 아래에 배치
def vld(a):
    try: return a
    except: return ""
        
def findstartpt(datas):
    res = []    
    for i in enumerate(datas):
        for j in enumerate(i[1]):
            cell = vld(j[1])
            try:
                if "[" in cell or "]" in cell: ### 동작하려면 엑셀의 시트 제목이 []를 포함해야함
                    res.append((i[0],j[0]))
            except: pass

    return res[0]

startpt = findstartpt(datas)

def incut(datas):
    s1 = datas[startpt[0]:]
    s2 = list(map(lambda a: a[startpt[1]:], s1))
    return s2

#head = lambda list: go(list,
#    filter(lambda a: chck_heads(a)),
#    )
    
result = incut(datas)
# 출력을 OUT 변수에 지정합니다.
OUT = result
# ----------------------------------------
