# Dynamo graph Qsurfacedivider.dyn (Dynamo 2.10.1.3976)

함수_라이브러리_함수_임포트_용 = Python()  # CPython3; unwired: IN[0]
# ---------- 함수_라이브러리_함수_임포트_용.python (67 lines) ----------
# Load the Python Standard and DesignScript Libraries
import sys
import clr
clr.AddReference('RevitAPI')
import Autodesk

clr.AddReference('ProtoGeometry')
from Autodesk.DesignScript.Geometry import *

clr.AddReference('RevitNodes')
import Revit
clr.ImportExtensions(Revit.Elements)

clr.ImportExtensions(Revit.GeometryConversion)
clr.ImportExtensions(Revit.GeometryReferences)

clr.AddReference('RevitServices')
import RevitServices
from RevitServices.Persistence import DocumentManager
from RevitServices.Transactions import TransactionManager

doc = DocumentManager.Instance.CurrentDBDocument

# The inputs to this node will be stored as a list in the IN variables.
dataEnteringNode = IN

# Place your code below this line
def repeatFuncApply(func, repeat, data_input):
    result = []
    input_forFunc = data_input
    while repeat != 0:
        result.append(func(input_forFunc))
        input_forFunc = func(input_forFunc)
        repeat = repeat - 1
    return result

def create_horizonLine(endpt):
    sttpt = Point.ByCoordinates(0,0,0)
    line_prime = Line.ByStartPointEndPoint(sttpt, endpt)
    return line_prime
    
def create_verticalLine(endpt):
    sttpt = Point.ByCoordinates(0,0,0)
    line_prime = Line.ByStartPointEndPoint(sttpt, endpt)
    return line_prime
    
def curveOffset(elem, dist):
    result = Curve.Offset(elem, dist)
    return result
    
def multiply_mk(a,b):
    return a * b





##########################################################
result = [
repeatFuncApply,
create_horizonLine,
create_verticalLine,
curveOffset,
multiply_mk
]	
# Assign your output to the OUT variable.
OUT = result
# ----------------------------------------
그리드길이 = DoubleInput(50000)  # graph input
그리드간격 = DoubleInput(6000)  # graph input
x축그리드갯수 = IntegerSlider(5, range=0..100 step 1)  # graph input
y축그리드갯수 = IntegerSlider(5, range=0..100 step 1)  # graph input
퀵_그리드_메이커_input = CodeBlock(그리드길이=그리드길이, 그리드간격=그리드간격, x축그리드갯수=x축그리드갯수, y축그리드갯수=y축그리드갯수) { 그리드길이; 그리드간격; x축그리드갯수; y축그리드갯수; }
퀵_그리드_메이커 = Python(IN[0]=함수_라이브러리_함수_임포트_용, IN[1]=퀵_그리드_메이커_input.그리드길이, IN[2]=퀵_그리드_메이커_input.그리드간격, IN[3]=퀵_그리드_메이커_input.x축그리드갯수, IN[4]=퀵_그리드_메이커_input.y축그리드갯수)  # CPython3; frozen
# ---------- 퀵_그리드_메이커.python (61 lines) ----------
# Load the Python Standard and DesignScript Libraries
import sys
import clr
clr.AddReference('RevitAPI')
import Autodesk

clr.AddReference('ProtoGeometry')
from Autodesk.DesignScript.Geometry import *

clr.AddReference('RevitNodes')
import Revit
clr.ImportExtensions(Revit.Elements)

clr.ImportExtensions(Revit.GeometryConversion)
clr.ImportExtensions(Revit.GeometryReferences)

clr.AddReference('RevitServices')
import RevitServices
from RevitServices.Persistence import DocumentManager
from RevitServices.Transactions import TransactionManager

doc = DocumentManager.Instance.CurrentDBDocument

############################################################
############### Function Import part - start ###############
repeatFuncApply = IN[0][0]
create_horizonLine = IN[0][1]
create_verticalLine = IN[0][2]
curveOffset = IN[0][3]
multi = IN[0][4]
############### Function Import part - end #################
############################################################

# The inputs to this node will be stored as a list in the IN variables.
dataEnteringNode = IN

gridlength = IN[1]
dist = IN[2]
repeat_X = IN[3]
repeat_Y = IN[4]
# Place your code below this line
endptX = Point.ByCoordinates(0,gridlength,0)
endptY = Point.ByCoordinates(gridlength,0,0)

line_primeX = create_horizonLine(endptX)
line_primeY = create_verticalLine(endptY)

lineforX = repeatFuncApply(lambda x: curveOffset(x, dist), repeat_X, line_primeX)
lineforY = repeatFuncApply(lambda x: curveOffset(x, -dist), repeat_Y, line_primeY)

grid_X = list(map(lambda x: x.ToRevitType(), lineforX))
grid_Y = list(map(lambda x: x.ToRevitType(), lineforY))
grid = grid_X + grid_Y

TransactionManager.Instance.EnsureInTransaction(doc)
gridAll = list(map(lambda x: Autodesk.Revit.DB.Grid.Create(doc, x), grid))
TransactionManager.Instance.TransactionTaskDone()
#result = [line_primeX, line_primeY]
result = gridAll
# Assign your output to the OUT variable.
OUT = result
# ----------------------------------------
함수_라이브러리_함수_임포트_용_2 = Python()  # CPython3; unwired: IN[0]
# ---------- 함수_라이브러리_함수_임포트_용_2.python (78 lines) ----------
# Load the Python Standard and DesignScript Libraries
import os
import sys
sys.path.append(os.getenv('LOCALAPPDATA').replace('\\','\\\\') + r'\Programs\Python\Python39\Lib\site-packages')
import clr
clr.AddReference('RevitAPI')
import Autodesk

clr.AddReference('ProtoGeometry')
from Autodesk.DesignScript.Geometry import *

clr.AddReference('RevitNodes')
import Revit
clr.ImportExtensions(Revit.Elements)

clr.ImportExtensions(Revit.GeometryConversion)
clr.ImportExtensions(Revit.GeometryReferences)

clr.AddReference('RevitServices')
import RevitServices
from RevitServices.Persistence import DocumentManager
from RevitServices.Transactions import TransactionManager

doc = DocumentManager.Instance.CurrentDBDocument

# The inputs to this node will be stored as a list in the IN variables.
dataEnteringNode = IN

# Place your code below this line
def repeatFuncApply(func, repeat, data_input):
    result = []
    input_forFunc = data_input
    while repeat != 0:
        result.append(func(input_forFunc))
        input_forFunc = func(input_forFunc)
        repeat = repeat - 1
    return result

def create_horizonLine(endpt):
    sttpt = Point.ByCoordinates(0,0,0)
    line_prime = Line.ByStartPointEndPoint(sttpt, endpt)
    return line_prime
    
def create_verticalLine(endpt):
    sttpt = Point.ByCoordinates(0,0,0)
    line_prime = Line.ByStartPointEndPoint(sttpt, endpt)
    return line_prime
    
def curveOffset(elem, dist):
    result = Curve.Offset(elem, dist)
    return result
    
def range_q(start, end, num):
    result = [start]
    between = num - 1
    gap = end - start
    step = gap / between
    for i in range(num):
        if i == 0:
            pass
        else:
            target = start + step * i
            result.append(target)
    return result



##########################################################
result = [
repeatFuncApply,
create_horizonLine,
create_verticalLine,
curveOffset,
range_q
]	

# Assign your output to the OUT variable.
OUT = result
# ----------------------------------------
code_block = CodeBlock { 1000; 2000; }
byWidthLength = Rectangle.ByWidthLength(width=code_block.out1, length=code_block.out0)
byPatch = Surface.ByPatch(closedCurve=byWidthLength)
python = Python(IN[0]=함수_라이브러리_함수_임포트_용_2, IN[1]=byPatch)  # CPython3
# ---------- python.python (47 lines) ----------
# Load the Python Standard and DesignScript Libraries
import os
import sys
sys.path.append(os.getenv('LOCALAPPDATA').replace('\\','\\\\') + r'\Programs\Python\Python39\Lib\site-packages')
import clr
clr.AddReference('RevitAPI')
import Autodesk

clr.AddReference('ProtoGeometry')
from Autodesk.DesignScript.Geometry import *

clr.AddReference('RevitNodes')
import Revit
clr.ImportExtensions(Revit.Elements)

clr.ImportExtensions(Revit.GeometryConversion)
clr.ImportExtensions(Revit.GeometryReferences)

clr.AddReference('RevitServices')
import RevitServices
from RevitServices.Persistence import DocumentManager
from RevitServices.Transactions import TransactionManager

doc = DocumentManager.Instance.CurrentDBDocument


############################################################
############### Function Import part - start ###############
repeatFuncApply = IN[0][0]
create_horizonLine = IN[0][1]
create_verticalLine = IN[0][2]
curveOffset = IN[0][3]
range_q = IN[0][4]
############### Function Import part - end #################
############################################################

# The inputs to this node will be stored as a list in the IN variables.
dataEnteringNode = IN
inputSrf = IN[1]

# Place your code below this line


result = inputSrf.PointAtParameter(0.5, 0.5)

# Assign your output to the OUT variable.
OUT = result
# ----------------------------------------
convexhull_class = Python()  # CPython3; unwired: IN[0], IN[1]
# ---------- convexhull_class.python (58 lines) ----------
# Load the Python Standard and DesignScript Libraries
import sys
import clr
clr.AddReference('ProtoGeometry')
from Autodesk.DesignScript.Geometry import *
from functools import reduce

# The inputs to this node will be stored as a list in the IN variables.
dataEnteringNode = IN

# Place your code below this line
class ConvexHull_Maker:
    def __init__(self, points):
        def convex_hull_graham(points):
            def ToVals(pt):
	            return [pt.X,pt.Y,pt.Z]
            def ToPts(ptVals):
	            return Point.ByCoordinates(ptVals[0],ptVals[1],ptVals[2])
	           
            def CreateOutline(pts):
                crvs = []
                i = 0
                while i < len(pts):
                    if i == len(pts)-1:
                        crvs.append(Line.ByStartPointEndPoint(pts[i],pts[0]))
                    else:
                        crvs.append(Line.ByStartPointEndPoint(pts[i],pts[i+1]))
                    i = i+1
                return PolyCurve.ByJoinedCurves(crvs)
	
            TURN_LEFT, TURN_RIGHT, TURN_NONE = (1, -1, 0)

            def cmp(a, b):
                return (a > b) - (a < b)
	
            def turn(p, q, r):
                return cmp((q[0] - p[0])*(r[1] - p[1]) - (r[0] - p[0])*(q[1] - p[1]), 0)
	
            def _keep_left(hull, r):
                while len(hull) > 1 and turn(hull[-2], hull[-1], r) != TURN_LEFT:
                    hull.pop()
                if not len(hull) or hull[-1] != r:
                    hull.append(r)
                return hull

            points = [ToVals(p) for p in points]	
            points = sorted(points)
            l = reduce(_keep_left, points, [])
            u = reduce(_keep_left, reversed(points), [])
            points = l.extend(u[i] for i in range(1, len(u) - 1)) or l
            points = [ToPts(p) for p in points]
            return CreateOutline(points)
            
        self.points = points
        result = convex_hull_graham(points)
        self.result = result
# Assign your output to the OUT variable.
OUT = ConvexHull_Maker
# ----------------------------------------
code_block_2 = CodeBlock { 0..1..#100; }
pointAtParameter = Surface.PointAtParameter(surface=byPatch, u=code_block_2, v=code_block_2, lacing=CrossProduct)
flatten = List.Flatten(list=pointAtParameter)
code_block_3 = CodeBlock { 10; }
code_block_4 = CodeBlock(i=flatten) { 0; List.Count(i); }
number_slider = DoubleSlider(138, range=0..999 step 1)
randomList = Math.RandomList(amount=code_block_3, value1=code_block_4.out0, value2=code_block_4.out1, seed=number_slider)
round = Math.Round(number=randomList)
getItemAtIndex = List.GetItemAtIndex(list=flatten, index=round)
python_script = Python(IN[0]=convexhull_class, IN[1]=getItemAtIndex)  # CPython3
# ---------- python_script.python (21 lines) ----------
# Load the Python Standard and DesignScript Libraries
import sys
import clr
clr.AddReference('ProtoGeometry')
from Autodesk.DesignScript.Geometry import *
from functools import reduce

# The inputs to this node will be stored as a list in the IN variables.
dataEnteringNode = IN

ConvexHull_Maker = IN[0]
inputPts = IN[1]
# Place your code below this line

cvxCrv = ConvexHull_Maker(inputPts).result
cvxSrf = Surface.ByPatch(cvxCrv)
cvxSolid = cvxSrf.Thicken(100, False)
result = cvxSolid

# Assign your output to the OUT variable.
OUT = result
# ----------------------------------------
code_block_5 = CodeBlock { 5; }
takeItems = List.TakeItems(list=pointAtParameter@L2, amount=code_block_5)
code_block_6 = CodeBlock { 10; }
takeItems_2 = List.TakeItems(list=takeItems, amount=code_block_6)
