# Dynamo graph family doc parameter.dyn (Dynamo 2.12.0.5650)

current = Document.Current()
byDocument = FamilyDocument.ByDocument(document=current)
code_block = CodeBlock { "C"; }
code_block_2 = CodeBlock { "(A * 2)"; }
setFormula = FamilyDocument.SetFormula(familyDocument=byDocument, parameterName=code_block, formula=code_block_2)
