# Dynamo graph 2-1_Room Separator(221201).dyn (Dynamo 2.13.1.3887)

code_block = CodeBlock { {}; }
code_block_2 = CodeBlock { "box obj"; }

# group: Generic Mass & Level select
categories = Categories("OST_GenericModel")
all_elements_of_category = ElementsOfCategory(Category=categories)

# group: set Dictionary
mkNewDicts = Python(IN[0]=code_block, IN[1]=code_block_2, IN[2]=all_elements_of_category)  # CPython3
# ---------- mkNewDicts.python (32 lines) ----------
# Load the Python Standard and DesignScript Libraries
import sys
import clr
clr.AddReference('ProtoGeometry')
from Autodesk.DesignScript.Geometry import *

# The inputs to this node will be stored as a list in the IN variables.
dataEnteringNode = IN

preDicts = IN[0]
newKey = IN[1]
newValues = IN[2]

# Place your code below this line

def mkNewDicts(preDicts, newKey, newValues):
    if preDicts == {}:
        preDicts = []
        list(map(lambda x: preDicts.append({}), newValues))
    else:
        pass

    dict_valuePairs = zip(preDicts, newValues)
    
    def mkNewDict(_dict, _key, _value):
        _dict[_key] = _value
        return _dict
    
    result = map(lambda x: mkNewDict(x[0], newKey, x[1]), dict_valuePairs)
    return result
# Assign your output to the OUT variable.
OUT = mkNewDicts(preDicts, newKey, newValues)
# ----------------------------------------

code_block_3 = CodeBlock(d=mkNewDicts) { d; }
code_block_4 = CodeBlock { "box obj"; }
valueAtKey = DesignScript.Builtin.Dictionary.ValueAtKey(dictionary=code_block_3, key=code_block_4)
code_block_5 = CodeBlock { "Level"; }
getParameterValueByName = Element.GetParameterValueByName(element=valueAtKey, parameterName=code_block_5)
string_from_object = FromObject(object=getParameterValueByName)
groupByKey = List.GroupByKey(list=valueAtKey, keys=string_from_object)

# group: 레벨 별 Box 정리
code_block_6 = CodeBlock(i=groupByKey.groups) { i; }

# group: 매스 중점 포인트 추출 및 리스트 정리
getLocation = Element.GetLocation(element=code_block_6)
flatten = List.Flatten(list=getLocation)
type = Object.Type(object=flatten)
firstItem = List.FirstItem(list=type)
removeIfNot = List.RemoveIfNot(list=getLocation@L2, type=firstItem)

# group: 작업평면 생성
byOriginNormal = Plane.ByOriginNormal(origin=getLocation)

geometry = Element.Geometry(element=code_block_6)
flatten_2 = List.Flatten(list=geometry@L3)

# group: 매스 바닥면 추출 및 리스트 정리
intersect = Geometry.Intersect(geometry=byOriginNormal, other=flatten_2, lacing=Shortest)
flatten_3 = List.Flatten(list=intersect@L3)
clean = List.Clean(list=flatten_3)

# group: 매스별 바운더리 라인 추출 및 리스트 정리
perimeterCurves = Surface.PerimeterCurves(surface=clean)  # frozen
clean_2 = List.Clean(list=perimeterCurves)
watch = Watch(clean_2)

list_flatten_매스별_바운더리_라인_추출_및 = List.Flatten(list=watch)  # "List.Flatten@매스별 바운더리 라인 추출 및 리스트 정리"

# group: 매스 집합의 최외곽선 추출(by Graham Scan)
startPoint = Curve.StartPoint(curve=watch)

# group: 포인트 중복제거
flatten_4 = List.Flatten(list=startPoint)
watch_2 = Watch(flatten_4)
string_from_object_2 = FromObject(object=watch_2)
중복제거 = Python(IN[0]=string_from_object_2)  # CPython3
# ---------- 중복제거.python (20 lines) ----------
# Load the Python Standard and DesignScript Libraries
import sys
import clr
clr.AddReference('ProtoGeometry')
from Autodesk.DesignScript.Geometry import *

# The inputs to this node will be stored as a list in the IN variables.
dataEnteringNode = IN
inList = IN[0]

# Place your code below this line
outList = []
for i in inList:
	if i in outList:
		pass
	else:
		outList.append(i)

# Assign your output to the OUT variable.
OUT = outList
# ----------------------------------------
allIndicesOf = List.AllIndicesOf(list=string_from_object_2, item=중복제거)
firstItem_2 = List.FirstItem(list=allIndicesOf@L2)
getItemAtIndex = List.GetItemAtIndex(list=flatten_4, index=firstItem_2)
flatten_5 = List.Flatten(list=getItemAtIndex)
Z = Point.Z(point=flatten_5)
uniqueItems = List.UniqueItems(list=Z)
allIndicesOf_2 = List.AllIndicesOf(list=Z, item=uniqueItems)
getItemAtIndex_2 = List.GetItemAtIndex(list=flatten_5, index=allIndicesOf_2@L2)

# group (continued): 매스 집합의 최외곽선 추출(by Graham Scan)
graham_scan = Python(IN[0]=getItemAtIndex_2)  # CPython3
# ---------- graham_scan.python (67 lines) ----------
# Load the Python Standard and DesignScript Libraries
import sys
import clr
clr.AddReference('ProtoGeometry')
from Autodesk.DesignScript.Geometry import *
clr.AddReference('GeometryColor')
from Modifiers import GeometryColor
from functools import reduce

# The inputs to this node will be stored as a list in the IN variables.
dataEnteringNode = IN
inputPoints = IN[0]

class ConvexHull_Maker:
    def __init__(self, points):
        def convex_hull_graham(points):
            def ToVals(pt):
	            return [pt.X,pt.Y,pt.Z]
            def ToPts(ptVals):
	            return Point.ByCoordinates(ptVals[0],ptVals[1],ptVals[2])
	           
            def CreateOutline(pts):
                crvs = []
                i = 0
                while i < len(pts):
                    if i == len(pts)-1:
                        crvs.append(Line.ByStartPointEndPoint(pts[i],pts[0]))
                    else:
                        crvs.append(Line.ByStartPointEndPoint(pts[i],pts[i+1]))
                    i = i+1
                return PolyCurve.ByJoinedCurves(crvs)
	
            TURN_LEFT, TURN_RIGHT, TURN_NONE = (1, -1, 0)

            def cmp(a, b):
                return (a > b) - (a < b)
	
            def turn(p, q, r):
                return cmp((q[0] - p[0])*(r[1] - p[1]) - (r[0] - p[0])*(q[1] - p[1]), 0)
	
            def _keep_left(hull, r):
                while len(hull) > 1 and turn(hull[-2], hull[-1], r) != TURN_LEFT:
                    hull.pop()
                if not len(hull) or hull[-1] != r:
                    hull.append(r)
                return hull

            points = [ToVals(p) for p in points]	
            points = sorted(points)
            l = reduce(_keep_left, points, [])
            u = reduce(_keep_left, reversed(points), [])
            points = l.extend(u[i] for i in range(1, len(u) - 1)) or l
            points = [ToPts(p) for p in points]
            return CreateOutline(points)
            
        self.points = points
        result = convex_hull_graham(points)
        self.result = result
        
# Place your code below this line

result = []
for i in inputPoints:
    result.append(ConvexHull_Maker(i).result)

# Assign your output to the OUT variable.
OUT = result
# ----------------------------------------

# group: Room Separator 기준 되는 커브들 추출 및 단일 리스트 생성
watch_매스_집합의_최외곽선_추출_by_graham = Watch(graham_scan)  # "Watch@매스 집합의 최외곽선 추출(by Graham Scan)"
explode = Geometry.Explode(geometry=watch_매스_집합의_최외곽선_추출_by_graham)
join = List.Join(list0=list_flatten_매스별_바운더리_라인_추출_및, list1=explode)

# group: Curve 레벨 별 정렬
flatten_6 = List.Flatten(list=join)
startPoint_2 = Curve.StartPoint(curve=flatten_6)
Z_2 = Point.Z(point=startPoint_2)
uniqueItems_2 = List.UniqueItems(list=Z_2)
allIndicesOf_3 = List.AllIndicesOf(list=Z_2, item=uniqueItems_2)
getItemAtIndex_3 = List.GetItemAtIndex(list=flatten_6, index=allIndicesOf_3@L2)

작업평면 = CodeBlock(i=byOriginNormal) { i; }
firstItem_3 = List.FirstItem(list=작업평면@L2)
byPlane = SketchPlane.ByPlane(plane=firstItem_3)

# group: Room Separator 배치 기준 View 추출
categories_2 = Categories("OST_Views")
all_elements_of_category_2 = ElementsOfCategory(Category=categories_2)
isNull = Object.IsNull(object=all_elements_of_category_2)
filterByBoolMask = List.FilterByBoolMask(list=all_elements_of_category_2, mask=isNull)
string_from_object_3 = FromObject(object=filterByBoolMask.out)
code_block_7 = CodeBlock { "Floor"; }
contains = String.Contains(string=string_from_object_3, searchFor=code_block_7)
filterByBoolMask_2 = List.FilterByBoolMask(list=filterByBoolMask.out, mask=contains)
string_from_object_4 = FromObject(object=filterByBoolMask_2.in)
code_block_8 = CodeBlock()
# ---------- code_block_8.designscript (7 lines) ----------
[
"G.L",
"2F",
"3F",
"4F",
"PF"
];
# ----------------------------------------
contains_2 = String.Contains(string=string_from_object_4, searchFor=code_block_8@L1)
code_block_9 = CodeBlock { true; }
allIndicesOf_4 = List.AllIndicesOf(list=contains_2@L2, item=code_block_9)
flatten_7 = List.Flatten(list=allIndicesOf_4)
getItemAtIndex_4 = List.GetItemAtIndex(list=filterByBoolMask_2.in, index=flatten_7)

# group: RoomSeparator.FromCurve
code_block_10 = CodeBlock(i=getItemAtIndex_3, sketchPlane=byPlane, view=getItemAtIndex_4) { i; sketchPlane; view; }
python_script = Python(IN[0]=code_block_10.i, IN[1]=code_block_10.sketchPlane, IN[2]=code_block_10.view)  # CPython3
# ---------- python_script.python (51 lines) ----------
import clr
clr.AddReference('RevitAPI')
from Autodesk.Revit.DB import *

clr.AddReference("RevitNodes")
import Revit
clr.ImportExtensions(Revit.GeometryConversion)

clr.AddReference("RevitServices")
import RevitServices
from RevitServices.Persistence import DocumentManager
from RevitServices.Transactions import TransactionManager

doc = DocumentManager.Instance.CurrentDBDocument
curveslist = UnwrapElement(IN[0])
sketchplaneslist = UnwrapElement(IN[1])
viewslist = UnwrapElement(IN[2])

def createRoomSeparator(curves, sketchplane, view):
    curvearray = CurveArray()
    for curve in curves:
    	curvearray.Append(curve.ToRevitType())
    doccreation = doc.Create
    separatorarray = doccreation.NewRoomBoundaryLines(sketchplane, curvearray, view)
    elementlist = []
    for item in separatorarray:
    	elementlist.append(item)
    
    return elementlist


TransactionManager.Instance.EnsureInTransaction(doc)

if len(curveslist) > 1:
    result = []
    for i in range(len(curveslist)):
        uni = createRoomSeparator(curveslist[i], sketchplaneslist[i], viewslist[i])
        result.append(uni)
else:
    result = createRoomSeparator(curveslist, sketchplaneslist, viewslist)

#result = createRoomSeparator(curveslist, sketchplaneslist, viewslist)

TransactionManager.Instance.TransactionTaskDone()
    





OUT = result
# ----------------------------------------

watch_3 = Watch(python_script)  # graph output
code_block_11 = CodeBlock { "box lv"; }

# group: set Dictionary
mkNewDicts_2 = Python(IN[0]=code_block_3, IN[1]=code_block_11, IN[2]=string_from_object)  # CPython3; same code as mkNewDicts

code_block_12 = CodeBlock(d=mkNewDicts_2) { d; }
code_block_13 = CodeBlock { "box cenPoint"; }
code_block_14 = CodeBlock { "box obj"; }
valueAtKey_2 = DesignScript.Builtin.Dictionary.ValueAtKey(dictionary=code_block_12, key=code_block_14)
getLocation_2 = Element.GetLocation(element=valueAtKey_2)

# group: set Dictionary
mkNewDicts_3 = Python(IN[0]=code_block_12, IN[1]=code_block_13, IN[2]=getLocation_2)  # CPython3; same code as mkNewDicts
