# Dynamo graph 04 Str Foundation_mk(220112).dyn (Dynamo 2.12.0.5650)

# note: 되메우기기

# group: Primary Input : Excel & Revit Elements
categories = Categories("OST_StructuralFoundation")
all_elements_of_category = ElementsOfCategory(Category=categories)
string_from_web = Python()  # CPython3; unwired: IN[0]
# ---------- string_from_web.python (19 lines) ----------
# Load the Python Standard and DesignScript Libraries
import sys
import clr
clr.AddReference('ProtoGeometry')
from Autodesk.DesignScript.Geometry import *
import urllib.request

# The inputs to this node will be stored as a list in the IN variables.
dataEnteringNode = IN
inputURL = "https://raw.githubusercontent.com/HNANmal/mQ/master/Hdynlib/General/ImportExcel.py"

# Place your code below this line
req = urllib.request
data = req.urlopen(inputURL)

result = data.read().decode("utf-8")

# Assign your output to the OUT variable.
OUT = result
# ----------------------------------------
file_path = Filename("상상진화\20220110\DMS(Data Matching Schedule)_R0(Seq2)_220110.xlsx")  # graph input
sheet_name = CodeBlock { "Str Foundations"; }
github_python_import_excel_by = PythonStringNode(script=string_from_web, IN[0]=file_path, IN[1]=sheet_name)  # "Github_Python@Import Excel(By OpenpyXl)"; CPython3

code_block = CodeBlock { 15; }
removeItemAtIndex = List.RemoveItemAtIndex(list=all_elements_of_category, indices=code_block)

# group (continued): Primary Input : Excel & Revit Elements
code_block_2 = CodeBlock(InputElement=removeItemAtIndex, InputData=github_python_import_excel_by) { _InputElement; _InputData; }

# group: GetFull WMCodeDescription PerElement
excelDataManagerNode = Python(IN[0]=code_block_2._InputElement, IN[1]=code_block_2._InputData)  # CPython3
# ---------- excelDataManagerNode.python (279 lines) ----------
# Load the Python Standard and DesignScript Libraries
import os
import sys
sys.path.append(os.getenv('LOCALAPPDATA').replace('\\','\\\\') + r'\Programs\Python\Python39\Lib\site-packages')
import clr
clr.AddReference('RevitAPI')
import Autodesk

clr.AddReference('ProtoGeometry')
from Autodesk.DesignScript.Geometry import *

clr.AddReference('RevitNodes')
import Revit
clr.ImportExtensions(Revit.Elements)

clr.ImportExtensions(Revit.GeometryConversion)
clr.ImportExtensions(Revit.GeometryReferences)

clr.AddReference('RevitServices')
import RevitServices
from RevitServices.Persistence import DocumentManager
from RevitServices.Transactions import TransactionManager

doc = DocumentManager.Instance.CurrentDBDocument

import random
import itertools
from functools import reduce
from collections import Iterable
import datetime
import openpyxl

def iterable(obj):
    return isinstance(obj, Iterable)

def findUnique(inputs):
    result = []
    for i in inputs:
        if i in result:
            pass
        else:
            result.append(i)
    return result

# The inputs to this node will be stored as a list in the IN variables.
dataEnteringNode = IN
inputElements = IN[0]
inputData = IN[1]
#inputSheetName = IN[2]

def importExcel(path, SheetNameIn):
    wb_obj = openpyxl.load_workbook(str(path), data_only=True)
    sheet_obj = wb_obj.get_sheet_by_name(str(SheetNameIn))

    m_row = sheet_obj.max_row
    m_col = sheet_obj.max_column

    listOut = []

    for i in range(1, m_row +1):
        listTemp = []
        for j in range(1, m_col + 1):
            cell_obj = sheet_obj.cell(row=i, column=j)
            listTemp.append(cell_obj.value)
            if len(listTemp) == m_col:
                listOut.append(listTemp)
    return listOut

def getUsedFamilyTypeOfModeling(elements):
    familyCode = list(map(lambda x: x.Name.split('_')[0], elements))
    unq_familyCode = findUnique(familyCode)
    return unq_familyCode
    
def createExcelDataDictionary(values):
    result = {}
    for i in range(len(values)):
        result[str(i)] = values[i]
    return result

def findTargetIndex(targets, list):
    result = []
    for target in targets:
        for i in range(len(list)):
            if target in str(list[i]):
                result.append(i)
            else:
                pass
    result.sort()
    return result
    
def GetValueAtKeys(keys, dictionary):
    result = [] 
    for i in keys:
        result.append(dictionary[str(i)])
    return result


# Place your code below this line
usedFamilyTypeOfModeling = getUsedFamilyTypeOfModeling(inputElements)
excelWholeDataSet = inputData#importExcel(inputFilePath, inputSheetName)
trExcelWholeDataSet = list(zip(*excelWholeDataSet))
excelColumnDataSet = createExcelDataDictionary(trExcelWholeDataSet)
excelRowDataSet = createExcelDataDictionary(excelWholeDataSet)
ColumnIndexOfUsedFamilyType = findTargetIndex(usedFamilyTypeOfModeling, trExcelWholeDataSet)
ColDataSetOfUsedFamilyType = GetValueAtKeys(ColumnIndexOfUsedFamilyType, excelColumnDataSet)
materialPerElementFromModeling = []
for i in inputElements:
    materialPerElementFromModeling.append(i.GetMaterials())
#list(map(lambda x: x.GetMaterials, inputElements)) "맵함수로 처리하면 리스트화 할 때 타입 변환 오류 남"

targetWMRowIndex = []
for i in ColDataSetOfUsedFamilyType:
    targetWMRowIndex.append(findTargetIndex(['000'], i))

rowDataSetOfUsedWM = []
for i in targetWMRowIndex:
    rowDataSetOfUsedWM.append(GetValueAtKeys(i, excelRowDataSet))

workGroup = []
for i in rowDataSetOfUsedWM:
    tmp = []
    for j in i:
        tmp.append(j[0])
    workGroup.append(tmp)
    
workMaster = []
for i in range(len(ColDataSetOfUsedFamilyType)):
    tmp=[]
    for k in targetWMRowIndex[i]:
        tmp.append(ColDataSetOfUsedFamilyType[i][k])
    workMaster.append(tmp)

matchedWM = []
for i in range(len(workGroup)):
    tmp = []
    for j in range(len(workGroup[i])):
        fullWM = workGroup[i][j] +"-"+ workMaster[i][j]
        tmp.append(fullWM)
    matchedWM.append(tmp)

matchedWorkGruopAndMasterCode = []
for i in matchedWM:
    if len(i) > 0:
        matchedWorkGruopAndMasterCode.append(i)
    else:
        pass

matchedWMDescription = []
for i in rowDataSetOfUsedWM:
    tmp=[]
    for j in i:
        tmp.append(j[1] +" "+ j[2] +" "+ j[3] +" "+ "("+ j[4] +")")
    if len(tmp) > 0:
        matchedWMDescription.append(tmp)
    else:
        pass

matchedWMUnit = []
for i in rowDataSetOfUsedWM:
    tmp=[]
    for j in i:
        tmp.append(j[4])
    if len(tmp) > 0:
        matchedWMUnit.append(tmp)
    else:
        pass

matchedWorkGruopAndMasterCode_flat = list(itertools.chain(*matchedWorkGruopAndMasterCode))
matchedWMDescription_flat = list(itertools.chain(*matchedWMDescription))

dic_WMandDescription_Excel = {}
for i in range(len(matchedWorkGruopAndMasterCode_flat)):
    dic_WMandDescription_Excel[matchedWorkGruopAndMasterCode_flat[i]] = matchedWMDescription_flat[i]

usedFamilyTypeInExcelOrder = list(map(lambda x: x[3], ColDataSetOfUsedFamilyType))
usedFamilyCodeInExcelOrder = findUnique(list(map(lambda x: x.split('_')[0], usedFamilyTypeInExcelOrder)))

dic_FamilyCodeandWM = {}
for i in range(len(usedFamilyCodeInExcelOrder)):
    dic_FamilyCodeandWM[usedFamilyCodeInExcelOrder[i]] = matchedWorkGruopAndMasterCode[i]

workMasterCodePerElement = []
familyCodePerElem = list(map(lambda x: x.Name.split('_')[0], inputElements))
for i in familyCodePerElem:
    workMasterCodePerElement.append(dic_FamilyCodeandWM[i])

materialNamePerElem = []
for i in materialPerElementFromModeling:
    tmp = []
    for j in i:
        tmp.append(j.Name)
    materialNamePerElem.append(tmp)

WMPerElementFromModeling = []
for i in materialNamePerElem:
    tmp = []
    for j in i:
        tmp.append(j.split('_')[0])
    WMPerElementFromModeling.append(tmp)

specPerElementFromModeling = []
for i in materialNamePerElem:
    tmp = []
    for j in i:
        a = j.split('_')
        del a[0]
        b = " ".join(a)
        tmp.append(b)
    specPerElementFromModeling.append(tmp)

WMPerElementFromModeling_flat = list(itertools.chain(*WMPerElementFromModeling))
specPerElementFromModeling_flat = list(itertools.chain(*specPerElementFromModeling))

dic_WMandDescription_Model = {}
for i in range(len(WMPerElementFromModeling_flat)):
    dic_WMandDescription_Model[WMPerElementFromModeling_flat[i]] = specPerElementFromModeling_flat[i]

def findAllKeys(dict):
    result = []
    for key in dict.keys():
        result.append(key)
    return result

def findAllValues(dict):
    result = []
    for key in dict.keys():
        result.append(dict[key])
    return result

keys_WMandDescription_Model = findAllKeys(dic_WMandDescription_Model)
keys_WMandDescription_Excel = findAllKeys(dic_WMandDescription_Excel)

keys_WMandDescription_Both = list(set(keys_WMandDescription_Model + keys_WMandDescription_Excel))
values_WMandDescription_Both = []
for i in keys_WMandDescription_Both:
    if i in keys_WMandDescription_Model:
        values_WMandDescription_Both.append(dic_WMandDescription_Model[i])
    else:
        values_WMandDescription_Both.append(dic_WMandDescription_Excel[i])

dic_WMandDescription_Both = {}
for i in range(len(keys_WMandDescription_Both)):
    dic_WMandDescription_Both[keys_WMandDescription_Both[i]] = values_WMandDescription_Both[i]

workMasterCodePerElementFromBoth = []
for i in range(len(workMasterCodePerElement)):
    #tmp = []
    a = WMPerElementFromModeling[i] + workMasterCodePerElement[i]
    b = findUnique(a)
    workMasterCodePerElementFromBoth.append(b)

specPerElement = []
for i in workMasterCodePerElementFromBoth:
    tmp = []
    for j in i:
        tmp.append(dic_WMandDescription_Both[j])
    specPerElement.append(tmp)

fullWMCodeDescriptionPerElement = []
for i in range(len(workMasterCodePerElementFromBoth)):
    tmp = []
    for j in range(len(workMasterCodePerElementFromBoth[i])):
        a = workMasterCodePerElementFromBoth[i][j] +": "+ specPerElement[i][j]
        tmp.append(a)
    fullWMCodeDescriptionPerElement.append(tmp)

fullWMinfo = {
"AllElement": inputElements,
"WorkMasterCodePerFamilyType": dic_FamilyCodeandWM,
"WorkMasterCodePerElementBoth": workMasterCodePerElementFromBoth,
"FullWMCodeDescriptionPerElement": fullWMCodeDescriptionPerElement
}



result = fullWMinfo

# Assign your output to the OUT variable.
OUT = result
# ----------------------------------------

# group: Organize AllElementInform AsDictionary
set_up_all_element_inform_as = Python(IN[0]=excelDataManagerNode)  # "Set Up All Element Inform as Dictionary"; CPython3
# ---------- set_up_all_element_inform_as.python (119 lines) ----------
# Load the Python Standard and DesignScript Libraries
import os
import sys
sys.path.append(os.getenv('LOCALAPPDATA').replace('\\','\\\\') + r'\Programs\Python\Python39\Lib\site-packages')
import clr
clr.AddReference('RevitAPI')
import Autodesk

clr.AddReference('ProtoGeometry')
from Autodesk.DesignScript.Geometry import *

clr.AddReference('RevitNodes')
import Revit
clr.ImportExtensions(Revit.Elements)

clr.ImportExtensions(Revit.GeometryConversion)
clr.ImportExtensions(Revit.GeometryReferences)

clr.AddReference('RevitServices')
import RevitServices
from RevitServices.Persistence import DocumentManager
from RevitServices.Transactions import TransactionManager

doc = DocumentManager.Instance.CurrentDBDocument

import random
import itertools
from functools import reduce
from collections import Iterable
import datetime
import openpyxl

def iterable(obj):
    return isinstance(obj, Iterable)

def findUnique(inputs):
    result = []
    for i in inputs:
        if i in result:
            pass
        else:
            result.append(i)
    return result

# The inputs to this node will be stored as a list in the IN variables.
dataEnteringNode = IN
inputDict = IN[0]


def importExcel(path, SheetNameIn):
    wb_obj = openpyxl.load_workbook(str(path), data_only=True)
    sheet_obj = wb_obj.get_sheet_by_name(str(SheetNameIn))

    m_row = sheet_obj.max_row
    m_col = sheet_obj.max_column

    listOut = []

    for i in range(1, m_row +1):
        listTemp = []
        for j in range(1, m_col + 1):
            cell_obj = sheet_obj.cell(row=i, column=j)
            listTemp.append(cell_obj.value)
            if len(listTemp) == m_col:
                listOut.append(listTemp)
    return listOut

def getUsedFamilyTypeOfModeling(elements):
    familyCode = list(map(lambda x: x.Name.split('_')[0], elements))
    unq_familyCode = findUnique(familyCode)
    return unq_familyCode
    
def createExcelDataDictionary(values):
    result = {}
    for i in range(len(values)):
        result[str(i)] = values[i]
    return result

def findTargetIndex(targets, list):
    result = []
    for target in targets:
        for i in range(len(list)):
            if target in str(list[i]):
                result.append(i)
            else:
                pass
    result.sort()
    return result
    
def GetValueAtKeys(keys, dictionary):
    result = [] 
    for i in keys:
        result.append(dictionary[str(i)])
    return result


# Place your code below this line
element = inputDict["AllElement"]
elementType = []
for i in element:
    elementType.append(i.Name)
familyCode = []
for i in elementType:
    familyCode.append(i.split("_")[0])
fullWMCodeDescriptionPerElement = inputDict["FullWMCodeDescriptionPerElement"]

resultDict = {
"Element": element,
"ElementType": elementType,
"FamilyCode": familyCode,
"FullWMCodeDescriptionPerElement": fullWMCodeDescriptionPerElement
}



result = resultDict

# Assign your output to the OUT variable.
OUT = result
# ----------------------------------------

# group: Select Target Family Element And Connected WorkMasters
code_block_3 = CodeBlock { 0; }
select_target_family_element_and = Python(IN[0]=set_up_all_element_inform_as, IN[1]=code_block_3)  # "Select Target Family Element And Connected WorkMasters"; CPython3
# ---------- select_target_family_element_and.python (138 lines) ----------
# Load the Python Standard and DesignScript Libraries
import os
import sys
sys.path.append(os.getenv('LOCALAPPDATA').replace('\\','\\\\') + r'\Programs\Python\Python39\Lib\site-packages')
import clr
clr.AddReference('RevitAPI')
import Autodesk

clr.AddReference('ProtoGeometry')
from Autodesk.DesignScript.Geometry import *

clr.AddReference('RevitNodes')
import Revit
clr.ImportExtensions(Revit.Elements)

clr.ImportExtensions(Revit.GeometryConversion)
clr.ImportExtensions(Revit.GeometryReferences)

clr.AddReference('RevitServices')
import RevitServices
from RevitServices.Persistence import DocumentManager
from RevitServices.Transactions import TransactionManager

doc = DocumentManager.Instance.CurrentDBDocument

import random
import itertools
from functools import reduce
from collections import Iterable
import datetime
import openpyxl

def iterable(obj):
    return isinstance(obj, Iterable)

def findUnique(inputs):
    result = []
    for i in inputs:
        if i in result:
            pass
        else:
            result.append(i)
    return result

# The inputs to this node will be stored as a list in the IN variables.
dataEnteringNode = IN
inputDict = IN[0]
inputIndex = IN[1]


def importExcel(path, SheetNameIn):
    wb_obj = openpyxl.load_workbook(str(path), data_only=True)
    sheet_obj = wb_obj.get_sheet_by_name(str(SheetNameIn))

    m_row = sheet_obj.max_row
    m_col = sheet_obj.max_column

    listOut = []

    for i in range(1, m_row +1):
        listTemp = []
        for j in range(1, m_col + 1):
            cell_obj = sheet_obj.cell(row=i, column=j)
            listTemp.append(cell_obj.value)
            if len(listTemp) == m_col:
                listOut.append(listTemp)
    return listOut

def getUsedFamilyTypeOfModeling(elements):
    familyCode = list(map(lambda x: x.Name.split('_')[0], elements))
    unq_familyCode = findUnique(familyCode)
    return unq_familyCode
    
def createExcelDataDictionary(values):
    result = {}
    for i in range(len(values)):
        result[str(i)] = values[i]
    return result

def findTargetIndex(targets, list):
    result = []
    for target in targets:
        for i in range(len(list)):
            if target in str(list[i]):
                result.append(i)
            else:
                pass
    result.sort()
    return result
    
def GetValueAtKeys(keys, dictionary):
    result = [] 
    for i in keys:
        result.append(dictionary[str(i)])
    return result


# Place your code below this line
fullWMCodeDescriptionPerElement = inputDict["FullWMCodeDescriptionPerElement"]
element = inputDict["Element"]
familyCode = inputDict["FamilyCode"]
familyCode_unique = findUnique(familyCode)
targetFamilyCode = familyCode_unique[inputIndex]
targetIndex = []
for i in range(len(familyCode)):
    if targetFamilyCode in familyCode[i]:
        targetIndex.append(i)
    else:
        pass

targetElements = []
for i in targetIndex:
    targetElements.append(element[i])

targetFamilyCode = []
for i in targetIndex:
    targetFamilyCode.append(element[i].Name)

WMforTargetElements = []
for i in targetIndex:
    WMforTargetElements.append(fullWMCodeDescriptionPerElement[i])

WMforTargetElements_flat = list(itertools.chain(*WMforTargetElements))
targetWMunique = findUnique(WMforTargetElements_flat)

resultDict = {
"TargetElements": targetElements,
"TargetFamilyCode": targetFamilyCode,
"WMforTargetElements": WMforTargetElements,
"TargetWMunique": targetWMunique
}



result = resultDict

# Assign your output to the OUT variable.
OUT = result
# ----------------------------------------

code_block_4 = CodeBlock(i=select_target_family_element_and) { i; }

# group: <Func 3> Input Manager
value_for_import_from_others = CodeBlock(MainInput=code_block_4) { MainInput; RefInput1; RefInput2; }  # unwired: RefInput1, RefInput2

# group: <Func 3> Disposal (잔토처리 1.2 비율)
watch = Watch(value_for_import_from_others.RefInput1)
토량_환산_계수 = DoubleInput(1)  # graph input
code_block_5 = CodeBlock(i=watch, 토량환산계수=토량_환산_계수) { Math.Round(List.Flatten(i)/1000000000, 2)*토량환산계수; }
code_block_6 = CodeBlock { "M3"; }
count = List.Count(list=watch)
ofRepeatedItem = List.OfRepeatedItem(item=code_block_6, amount=count)
# note: 잔토처리
code_block_7 = CodeBlock(FuncValues=code_block_5, FuncValuesUnit=ofRepeatedItem)
# ---------- code_block_7.designscript (4 lines) ----------
{
"FuncValues": _FuncValues,
"FuncValuesUnit": _FuncValuesUnit
};
# ----------------------------------------

# group: <Func 3> Output Manager
output = CodeBlock(MainOutput=code_block_7) { MainOutput; RefOutput_geoColor; }  # unwired: RefOutput_geoColor
reference_output = CodeBlock { ref; }  # unwired: ref

# group: <Func 4> Input Manager
value_for_import_from_others_2 = CodeBlock(MainInput=code_block_4) { MainInput; RefInput1; RefInput2; }  # unwired: RefInput1, RefInput2

code_block_8 = CodeBlock { 300; 100; }

# group: <Func 4> Base Course
code_block_9 = CodeBlock { "TargetElements"; }
valueAtKey = DesignScript.Builtin.Dictionary.ValueAtKey(dictionary=value_for_import_from_others_2.MainInput, key=code_block_9)
# note: <Func>
createBaseCourseSurfaces = Custom[CreateBaseCourseSurfaces](Element=valueAtKey, BaseCourseOffsetBottom=code_block_8.out0, leanThick=code_block_8.out1)
area = Surface.Area(surface=createBaseCourseSurfaces.Surface)
code_block_10 = CodeBlock(i=area) { Math.Round(List.Flatten(i)/1000000, 2); }
code_block_11 = CodeBlock { "M2"; }
count_2 = List.Count(list=code_block_10)
ofRepeatedItem_2 = List.OfRepeatedItem(item=code_block_11, amount=count_2)
code_block_12 = CodeBlock(FuncValues=code_block_10, FuncValuesUnit=ofRepeatedItem_2)  # same code as code_block_7

# group: <Func 4> Output Manager
output_2 = CodeBlock(MainOutput=code_block_12, RefOutput_geoColor=createBaseCourseSurfaces.GeometryColor) { MainOutput; RefOutput_geoColor; }
reference_output_2 = CodeBlock { ref; }  # unwired: ref

# group: <Func 5> Input Manager
value_for_import_from_others_3 = CodeBlock(MainInput=code_block_4) { MainInput; RefInput; }  # unwired: RefInput

# group: <Func 5> Lean Concrete
code_block_13 = CodeBlock { "TargetElements"; }
valueAtKey_2 = DesignScript.Builtin.Dictionary.ValueAtKey(dictionary=value_for_import_from_others_3.MainInput, key=code_block_13)
# note: <Func>
createLeanConcrete = Custom[CreateLeanConcrete](Element=valueAtKey_2)
volume = Solid.Volume(solid=createLeanConcrete.Solid)
code_block_14 = CodeBlock(i=volume) { Math.Round(List.Flatten(i)/1000000000, 2); }
code_block_15 = CodeBlock { "M3"; }
count_3 = List.Count(list=code_block_14)
ofRepeatedItem_3 = List.OfRepeatedItem(item=code_block_15, amount=count_3)
code_block_16 = CodeBlock(FuncValues=code_block_14, FuncValuesUnit=ofRepeatedItem_3)  # same code as code_block_7
flatten = List.Flatten(list=createLeanConcrete.Solid)
value_for_export_to_others = CodeBlock(린콘크리트형상=flatten) { 린콘크리트형상; }

# group: <Func 5> Output Manager
output_3 = CodeBlock(MainOutput=code_block_16, RefOutput_geoColor=createLeanConcrete.GeometryColor) { MainOutput; RefOutput_geoColor; }
reference_output_3 = CodeBlock(ref=value_for_export_to_others) { ref; }

# group: <Func 6> Input Manager
value_for_import_from_others_4 = CodeBlock(MainInput=code_block_4) { MainInput; RefInput1; RefInput2; }  # unwired: RefInput1, RefInput2

# group: <Func 6> Form Works
code_block_17 = CodeBlock { "TargetElements"; }
valueAtKey_3 = DesignScript.Builtin.Dictionary.ValueAtKey(dictionary=value_for_import_from_others_4.MainInput, key=code_block_17)
code_block_18 = CodeBlock { "M2"; }
# note: <Func>
extractSideFacesOfElement = Custom[ExtractSideFacesOfElement](Element=valueAtKey_3)

extractSideFacesOfElement_2 = Python(IN[0]=valueAtKey_3)  # CPython3
# ---------- extractSideFacesOfElement_2.python (21 lines) ----------
# Load the Python Standard and DesignScript Libraries
import sys
import clr
clr.AddReference('ProtoGeometry')
from Autodesk.DesignScript.Geometry import *

# The inputs to this node will be stored as a list in the IN variables.
dataEnteringNode = IN
_inputs = IN[0]
# Place your code below this line
def main():
    def findSideSrf(input):
        geo = input.Geometry()[0]
        allSrf = geo.Explode()
        sideSrf = [i for i in allSrf if round(i.NormalAtParameter(0.5,0.5).Z)==0]
        
        return sideSrf
        
    return [findSideSrf(i) for i in _inputs]
# Assign your output to the OUT variable.
OUT = main()
# ----------------------------------------

# group (continued): <Func 6> Form Works
area_2 = Surface.Area(surface=extractSideFacesOfElement_2)
sum = Math.Sum(values=area_2)
code_block_19 = CodeBlock(i=sum) { Math.Round(List.Flatten(i)/1000000, 2); }
count_4 = List.Count(list=code_block_19)
ofRepeatedItem_4 = List.OfRepeatedItem(item=code_block_18, amount=count_4)
code_block_20 = CodeBlock(FuncValues=code_block_19, FuncValuesUnit=ofRepeatedItem_4)  # same code as code_block_7

# group: <Func 6> Output Manager
output_4 = CodeBlock(MainOutput=code_block_20, RefOutput_geoColor=extractSideFacesOfElement.GeometryColor) { MainOutput; RefOutput_geoColor; }
reference_output_4 = CodeBlock { ref; }  # unwired: ref

# group: <Func 7> Input Manager
value_for_import_from_others_5 = CodeBlock(MainInput=code_block_4) { MainInput; RefInput1; RefInput2; factor; }  # unwired: RefInput1, RefInput2, factor

# group: <Func 7> Rebar
code_block_21 = CodeBlock { "TargetElements"; }
valueAtKey_4 = DesignScript.Builtin.Dictionary.ValueAtKey(dictionary=value_for_import_from_others_5.MainInput, key=code_block_21)
code_block_22 = CodeBlock { "Volume"; }
getParameterValueByName = Element.GetParameterValueByName(element=valueAtKey_4, parameterName=code_block_22)
# note: <Func>
독립기초_철근비 = DoubleInput(0)  # graph input
mul = getParameterValueByName * 독립기초_철근비
code_block_23 = CodeBlock(i=mul) { Math.Round(List.Flatten(i)/1, 2); }
code_block_24 = CodeBlock { "TON"; }
count_5 = List.Count(list=code_block_23)
ofRepeatedItem_5 = List.OfRepeatedItem(item=code_block_24, amount=count_5)
code_block_25 = CodeBlock(FuncValues=code_block_23, FuncValuesUnit=ofRepeatedItem_5)  # same code as code_block_7

# group: <Func 7> Output Manager
output_5 = CodeBlock(MainOutput=code_block_25) { MainOutput; RefOutput_geoColor; }  # unwired: RefOutput_geoColor
reference_output_5 = CodeBlock { ref; }  # unwired: ref

# group: <Func 8> Input Manager
value_for_import_from_others_6 = CodeBlock(MainInput=code_block_4) { MainInput; RefInput1; RefInput2; }  # unwired: RefInput1, RefInput2

# group: <Func 8> Sheet Memebrane
code_block_26 = CodeBlock { "TargetElements"; }
valueAtKey_5 = DesignScript.Builtin.Dictionary.ValueAtKey(dictionary=value_for_import_from_others_6.MainInput, key=code_block_26)
# note: <Func>
createLeanConcrete_2 = Custom[CreateLeanConcrete](Element=valueAtKey_5)
area_3 = Surface.Area(surface=createLeanConcrete_2.Surface)
code_block_27 = CodeBlock(i=area_3) { Math.Round(List.Flatten(i)/1000000, 2); }
code_block_28 = CodeBlock { "M2"; }
count_6 = List.Count(list=code_block_27)
ofRepeatedItem_6 = List.OfRepeatedItem(item=code_block_28, amount=count_6)
code_block_29 = CodeBlock(FuncValues=code_block_27, FuncValuesUnit=ofRepeatedItem_6)  # same code as code_block_7

# group: <Func 8> Output Manager
output_6 = CodeBlock(MainOutput=code_block_29) { MainOutput; RefOutput_geoColor; }  # unwired: RefOutput_geoColor
reference_output_6 = CodeBlock { ref; }  # unwired: ref

# group: <Func 9> Input Manager
value_for_import_from_others_7 = CodeBlock(MainInput=code_block_4) { MainInput; RefInput1; RefInput2; }  # unwired: RefInput1, RefInput2

# group: <Func 9> Membrane Protection Board (측면 + 상부면 중 pedestal 점유면적 제외)
code_block_30 = CodeBlock { "TargetElements"; }
# note: <Func>
valueAtKey_6 = DesignScript.Builtin.Dictionary.ValueAtKey(dictionary=value_for_import_from_others_7.MainInput, key=code_block_30)
code_block_31 = CodeBlock(Element=valueAtKey_6) { _Element; }
extractUpperFacesOfElement = Custom[ExtractUpperFacesOfElement](Element=code_block_31)
flatten_2 = List.Flatten(list=extractUpperFacesOfElement.Surface)
getJoinedElements = Element.GetJoinedElements(element=code_block_31)
flatten_3 = List.Flatten(list=getJoinedElements)
extractBelowFacesOfElement = Custom[ExtractBelowFacesOfElement](Element=flatten_3)
flatten_4 = List.Flatten(list=extractBelowFacesOfElement.Surface)
doesIntersect = Geometry.DoesIntersect(geometry=flatten_4, other=flatten_2, lacing=CrossProduct)
code_block_32 = CodeBlock { true; }
allIndicesOf = List.AllIndicesOf(list=doesIntersect@L2, item=code_block_32)
flatten_5 = List.Flatten(list=allIndicesOf)
groupByKey = List.GroupByKey(list=flatten_4, keys=flatten_5)
difference = Surface.Difference(surface=flatten_2, others=groupByKey.groups)
extractSideFacesOfElement_3 = Custom[ExtractSideFacesOfElement](Element=code_block_31)
addItemToFront = List.AddItemToFront(item=difference@L1, list=extractSideFacesOfElement_3.Surface@L2)
area_4 = Surface.Area(surface=addItemToFront)
sum_2 = Math.Sum(values=area_4)
code_block_33 = CodeBlock(i=sum_2) { Math.Round(List.Flatten(i)/1000000, 2); }
code_block_34 = CodeBlock { "M2"; }
count_7 = List.Count(list=code_block_33)
ofRepeatedItem_7 = List.OfRepeatedItem(item=code_block_34, amount=count_7)
code_block_35 = CodeBlock(FuncValues=code_block_33, FuncValuesUnit=ofRepeatedItem_7)  # same code as code_block_7
color_palette = ColorPalette({R: 30, G: 144, B: 255, A: 129})
byGeometryColor = Modifiers.GeometryColor.ByGeometryColor(geometry=addItemToFront, color=color_palette)

# group: <Func 9> Output Manager
output_7 = CodeBlock(MainOutput=code_block_35, RefOutput_geoColor=byGeometryColor) { MainOutput; RefOutput_geoColor; }
reference_output_7 = CodeBlock { ref; }  # unwired: ref

join = List.Join(list3=output.MainOutput, list4=output_2.MainOutput, list5=output_3.MainOutput, list6=output_4.MainOutput, list7=output_5.MainOutput, list8=output_6.MainOutput, list9=output_7.MainOutput)  # unwired: list0, list1, list2

# group: TargetWMunique + Data Sending
code_block_36 = CodeBlock(InputDic2=join) { _InputDic2; }
count_8 = List.Count(list=code_block_36)
code_block_37 = CodeBlock(InputDic1=code_block_4) { _InputDic1; }
code_block_38 = CodeBlock { "TargetWMunique"; }
valueAtKey_7 = DesignScript.Builtin.Dictionary.ValueAtKey(dictionary=code_block_37, key=code_block_38)
watch_2 = Watch(valueAtKey_7)
count_9 = List.Count(list=watch_2)
eq = count_8 == count_9
organizeFuncValuesAndWorkMasterAsDiction = Custom[OrganizeFuncValuesAndWorkMasterAsDictionary](InputDic1=code_block_37, InputDic2=code_block_36)
watch_3 = Watch()  # unwired: arg0
if_ = If(test=eq, true=organizeFuncValuesAndWorkMasterAsDiction, false=watch_3)

# group: 데이터 취합 및 Row 방향 정렬
code_block_39 = CodeBlock(InputDic=if_) { _InputDic; }
code_block_40 = CodeBlock { "TrTargetFamilyCode"; }
valueAtKey_8 = DesignScript.Builtin.Dictionary.ValueAtKey(dictionary=code_block_39, key=code_block_40)
watch_4 = Watch(valueAtKey_8)
flatten_6 = List.Flatten(list=watch_4)
code_block_41 = CodeBlock { "WMforTargetElements"; }
valueAtKey_9 = DesignScript.Builtin.Dictionary.ValueAtKey(dictionary=code_block_39, key=code_block_41)
watch_5 = Watch(valueAtKey_9)
flatten_7 = List.Flatten(list=watch_5)
code_block_42 = CodeBlock { "TargetFuncValues"; }
valueAtKey_10 = DesignScript.Builtin.Dictionary.ValueAtKey(dictionary=code_block_39, key=code_block_42)
watch_6 = Watch(valueAtKey_10)
flatten_8 = List.Flatten(list=watch_6)
code_block_43 = CodeBlock { "TargetFuncValuesUnit"; }
valueAtKey_11 = DesignScript.Builtin.Dictionary.ValueAtKey(dictionary=code_block_39, key=code_block_43)
watch_7 = Watch(valueAtKey_11)
flatten_9 = List.Flatten(list=watch_7)
list_create = List.Create(item0=flatten_6, item1=flatten_7, item2=flatten_8, item3=flatten_9)
transpose = List.Transpose(lists=list_create)

# group: <Func 4> Visual Manager
visual_켜기_끄기 = BoolSelector(true)
visual_manager = Python(IN[0]=output_2.RefOutput_geoColor, IN[1]=visual_켜기_끄기)  # CPython3
# ---------- visual_manager.python (18 lines) ----------
# Load the Python Standard and DesignScript Libraries
import sys
import clr
clr.AddReference('ProtoGeometry')
from Autodesk.DesignScript.Geometry import *

# The inputs to this node will be stored as a list in the IN variables.
dataEnteringNode = IN
geoColors = IN[0]
blnForVisual = IN[1]

# Place your code below this line
if blnForVisual == True:
    result = geoColors
else:
    result = 0
# Assign your output to the OUT variable.
OUT = result
# ----------------------------------------

# group: <Func 5> Visual Manager
visual_켜기_끄기_2 = BoolSelector(true)
visual_manager_2 = Python(IN[0]=output_3.RefOutput_geoColor, IN[1]=visual_켜기_끄기_2)  # CPython3; same code as visual_manager

# group: <Func 6> Visual Manager
visual_켜기_끄기_3 = BoolSelector(true)
visual_manager_3 = Python(IN[0]=output_4.RefOutput_geoColor, IN[1]=visual_켜기_끄기_3)  # CPython3; same code as visual_manager

# group: <Func 6> Visual Manager
visual_켜기_끄기_4 = BoolSelector(true)
visual_manager_4 = Python(IN[0]=output_7.RefOutput_geoColor, IN[1]=visual_켜기_끄기_4)  # CPython3; same code as visual_manager

watch_8 = Watch(select_target_family_element_and)

# group: 사용된 패밀리 타입 종류 확인 구간
code_block_44 = CodeBlock { "ElementType"; }
valueAtKey_12 = DesignScript.Builtin.Dictionary.ValueAtKey(dictionary=set_up_all_element_inform_as, key=code_block_44)
uniqueItems = List.UniqueItems(list=valueAtKey_12)
watch_9 = Watch(uniqueItems)
code_block_45 = CodeBlock { "FamilyCode"; }
valueAtKey_13 = DesignScript.Builtin.Dictionary.ValueAtKey(dictionary=set_up_all_element_inform_as, key=code_block_45)
uniqueItems_2 = List.UniqueItems(list=valueAtKey_13)
watch_10 = Watch(uniqueItems_2)

# group: Input Manager
value_for_import_from_others_8 = CodeBlock(MainInput=code_block_4) { MainInput; RefInput1; RefInput2; }  # unwired: RefInput1, RefInput2

# group: <Func 00>Crushed Stone
code_block_46 = CodeBlock { "TargetElements"; }
valueAtKey_14 = DesignScript.Builtin.Dictionary.ValueAtKey(dictionary=value_for_import_from_others_8.MainInput, key=code_block_46)
# note: <Func>
code_block_47 = CodeBlock { 300; 100; }
createBaseCourseSurfaces_2 = Custom[CreateBaseCourseSurfaces](Element=valueAtKey_14, BaseCourseOffsetBottom=code_block_47.out0, leanThick=code_block_47.out1)
boolean = BoolSelector(false)
thicken = Surface.Thicken(surface=createBaseCourseSurfaces_2.Surface, thickness=code_block_47.out0, both_sides=boolean)
volume_2 = Solid.Volume(solid=thicken)
code_block_48 = CodeBlock(i=volume_2) { Math.Round(List.Flatten(i)/1000000000, 2); }
code_block_49 = CodeBlock { "M3"; }
count_10 = List.Count(list=code_block_48)
ofRepeatedItem_8 = List.OfRepeatedItem(item=code_block_49, amount=count_10)
code_block_50 = CodeBlock(FuncValues=code_block_48, FuncValuesUnit=ofRepeatedItem_8)  # same code as code_block_7

# group: Output Manager
output_8 = CodeBlock(MainOutput=code_block_50) { MainOutput; RefOutput_geoColor; }  # unwired: RefOutput_geoColor
reference_output_8 = CodeBlock { ref; }  # unwired: ref

code_block_51 = CodeBlock(i=set_up_all_element_inform_as) { i["ElementType"]; }
uniqueItems_3 = List.UniqueItems(list=code_block_51)

# group: 개념도
code_block_52 = CodeBlock { getTargetGeometry; }  # unwired: getTargetGeometry
code_block_53 = CodeBlock { calculate; }  # unwired: calculate
code_block_54 = CodeBlock { correctValue; }  # unwired: correctValue
assemble_function = Python(IN[0]=code_block_52, IN[1]=code_block_53, IN[2]=code_block_54)  # CPython3; frozen
# ---------- assemble_function.python (20 lines) ----------
# Load the Python Standard and DesignScript Libraries
import sys
import clr
clr.AddReference('ProtoGeometry')
from Autodesk.DesignScript.Geometry import *

# The inputs to this node will be stored as a list in the IN variables.
dataEnteringNode = IN

# Place your code below this line
def judgeWM(wm, elem):
    if elem.element
    pass

def assembleFunc(targetGeofunc, getvaluefunc, correctfunc):
    pass


# Assign your output to the OUT variable.
OUT = 0
# ----------------------------------------

name = Element.Name(element=removeItemAtIndex)
create_calcds = Python(IN[0]=excelDataManagerNode)  # CPython3; frozen; unwired: IN[1], IN[2]
# ---------- create_calcds.python (64 lines) ----------
# Load the Python Standard and DesignScript Libraries
import sys
import clr
clr.AddReference('ProtoGeometry')
from Autodesk.DesignScript.Geometry import *

# The inputs to this node will be stored as a list in the IN variables.
dataEnteringNode = IN
allElem = IN[0]["AllElement"]
wmCodePerElem = IN[0]["WorkMasterCodePerElementBoth"]
wmDescPerElem = IN[0]["FullWMCodeDescriptionPerElement"]

def pairForDs(allElem, wmDescPerElem):
    result = []
    for i in range(len(allElem)):
        result.append((allElem[i], wmDescPerElem[i]))
    return result
    
allPair = pairForDs(allElem, wmDescPerElem)
# Place your code below this line

    
def create_CalcDS(pair):
    #init#
    elem = pair[0]
    wmDescPerElem = pair[1]
    name = elem.Name
    familyCode = name.split("_")[0]
    geometry = elem.Geometry()[0]
    familyClass = elem.ElementType.GetParameterValueByName("Family Name")
    def findLevel():
        if "Wall" in familyClass:
            level = elem.GetParameterValueByName("Base Constraint")
        elif "Column" in familyClass:
            level = elem.GetParameterValueByName("Base Level")
        elif "Stair" in familyClass:
            level = elem.GetParameterValueByName("Base Level")
        elif "Beam" in familyClass:
            level = elem.GetParameterValueByName("Reference Level")
        else:
            level = elem.GetParameterValueByName("Level")
        return level
    level = findLevel()
    
    result = {
        "name": name,
        "elem": elem,
        "familyCode": familyCode,
        "familyClass": familyClass,
        "level": level,
        "geometry": geometry,
        "wmDescPerElem": wmDescPerElem,
        #"": ,
        }
    return result

#result = list(
#                map(lambda i:
#                    map(lambda j: create_CalcDS(i, j), wmDescPerElem)
#                , allElem)
#              )
result = [create_CalcDS(i) for i in allPair]
# Assign your output to the OUT variable.
OUT = result
# ----------------------------------------
code_block_55 = CodeBlock(i=create_calcds)
# ---------- code_block_55.designscript (2 lines) ----------
i[0];
//["geometry"];
# ----------------------------------------
elementType = Element.ElementType(element=code_block_2._InputElement)
parameters = Element.Parameters(element=elementType)
code_block_56 = CodeBlock { "Family Name"; }
getParameterValueByName_2 = Element.GetParameterValueByName(element=elementType, parameterName=code_block_56)
seeVisual = Python()  # CPython3; unwired: IN[0]; starter script, not edited (OUT = 0)
createElemDS = Python(IN[0]=set_up_all_element_inform_as)  # CPython3
# ---------- createElemDS.python (47 lines) ----------
# Load the Python Standard and DesignScript Libraries
import sys
import clr
clr.AddReference('ProtoGeometry')
from Autodesk.DesignScript.Geometry import *

# The inputs to this node will be stored as a list in the IN variables.
dataEnteringNode = IN
elemDics = IN[0]
elems = elemDics["Element"]
elemTypes = elemDics["ElementType"]
WMperElems = elemDics["FullWMCodeDescriptionPerElement"]
idx = range(len(elems))
# Place your code below this line
def ElemDS(i, elems, elemTypes, WMperElems):
    elem = elems[i]
    elemType = elemTypes[i]
    familyCode = elemType.split('_')[0]
    WMperElem = WMperElems[i]
    familyClass = elem.ElementType.GetParameterValueByName("Family Name")
    
    def findLevel():
        if "Wall" in familyClass:
            level = elem.GetParameterValueByName("Base Constraint")
        elif "Column" in familyClass:
            level = elem.GetParameterValueByName("Base Level")
        elif "Stair" in familyClass:
            level = elem.GetParameterValueByName("Base Level")
        elif "Beam" in familyClass:
            level = elem.GetParameterValueByName("Reference Level")
        else:
            level = elem.GetParameterValueByName("Level")
        return level
    level = findLevel()
    
    result = {
        "elem": elem,
        "elemType": elemType,
        "level": level,
        "familyCode": familyCode,
        "WMperElem": WMperElem,
    }
    
    return result

# Assign your output to the OUT variable.
OUT = [ElemDS(i, elems, elemTypes, WMperElems) for i in idx]
# ----------------------------------------
콘크리트물량산출함수 = Python()  # CPython3; unwired: IN[0]
# ---------- 콘크리트물량산출함수.python (33 lines) ----------
# Load the Python Standard and DesignScript Libraries
import sys
import clr
clr.AddReference('RevitAPI')
from Autodesk.Revit.DB import *
import Autodesk

clr.AddReference('RevitNodes')
import Revit
clr.ImportExtensions(Revit.Elements)

clr.AddReference('RevitServices')
import RevitServices
from RevitServices.Persistence import DocumentManager
doc = DocumentManager.Instance.CurrentDBDocument
collector = FilteredElementCollector(doc)#Autodesk.Revit.DB.FilteredElementCollector(doc)

clr.AddReference('ProtoGeometry')
from Autodesk.DesignScript.Geometry import *

from itertools import chain

# The inputs to this node will be stored as a list in the IN variables.
dataEnteringNode = IN
_inputs = IN[0]
# Place your code below this line
def 콘크리트물량산출함수(input):
    target = input
    
    return (target, target.GetParameterValueByName("Volume"), "M3")

# Assign your output to the OUT variable.
OUT = (콘크리트물량산출함수,["Footing-Rectangular","SOG"],[": Structural Concrete"],["M3"])
# ----------------------------------------
거푸집산출함수 = Python()  # CPython3; unwired: IN[0]
# ---------- 거푸집산출함수.python (35 lines) ----------
# Load the Python Standard and DesignScript Libraries
import sys
import clr
clr.AddReference('RevitAPI')
from Autodesk.Revit.DB import *
import Autodesk

clr.AddReference('RevitNodes')
import Revit
clr.ImportExtensions(Revit.Elements)

clr.AddReference('RevitServices')
import RevitServices
from RevitServices.Persistence import DocumentManager
doc = DocumentManager.Instance.CurrentDBDocument
collector = FilteredElementCollector(doc)#Autodesk.Revit.DB.FilteredElementCollector(doc)

clr.AddReference('ProtoGeometry')
from Autodesk.DesignScript.Geometry import *

from itertools import chain

# The inputs to this node will be stored as a list in the IN variables.
dataEnteringNode = IN
_inputs = IN[0]
# Place your code below this line
def 거푸집산출함수(input):
    geo = input.Geometry()[0]
    allSrf = geo.Explode()
    sideSrf = [i for i in allSrf if round(i.NormalAtParameter(0.5,0.5).Z)==0]
    
    return (sideSrf, sum([i.Area for i in sideSrf])/1000000, "M2")

# Assign your output to the OUT variable.
OUT = (거푸집산출함수,["Footing-Rectangular"],[": Form"],["M2"])
# ----------------------------------------
온통_터파기_여부 = BoolSelector(false)  # graph input
excavationBttmOffset = DoubleInput(300)  # graph input
leanThk = DoubleInput(50)  # graph input
경사_비율_입력_1_x_for_isofdn = DoubleInput(2)  # graph input
터파기산출함수 = Python(IN[1]=온통_터파기_여부, IN[3]=excavationBttmOffset, IN[4]=leanThk, IN[5]=경사_비율_입력_1_x_for_isofdn)  # CPython3; unwired: IN[0], IN[2]
# ---------- 터파기산출함수.python (107 lines) ----------
# Load the Python Standard and DesignScript Libraries
import sys
import clr

clr.AddReference('RevitAPI')
from Autodesk.Revit.DB import *
import Autodesk

clr.AddReference('RevitNodes')
import Revit
clr.ImportExtensions(Revit.Elements)

clr.AddReference('RevitServices')
import RevitServices
from RevitServices.Persistence import DocumentManager
doc = DocumentManager.Instance.CurrentDBDocument
collector1 = FilteredElementCollector(doc)#Autodesk.Revit.DB.FilteredElementCollector(doc)

clr.AddReference('ProtoGeometry')
from Autodesk.DesignScript.Geometry import *

allFdns = collector1.OfCategory(BuiltInCategory.OST_StructuralFoundation).WhereElementIsNotElementType().ToElements()
allIsoFdns = [i.ToDSType(False) for i in allFdns if "Footing-" in i.Name]

# The inputs to this node will be stored as a list in the IN variables.
dataEnteringNode = IN
refFunc = IN[0]
wholeExcavationBln = IN[1]
inputDS = IN[2]
bttmOffset = IN[3]
leanThk = IN[4]
slopeExcav = IN[5]



# Place your code below this line

def 터파기산출함수(input):
    targets = []
    
    if wholeExcavationBln:
        calcTargetNum = len(allIsoFdns)
        fdnsGeo = [i.Geometry()[0] for i in allIsoFdns]
        bdBox_fdn = BoundingBox.ByGeometry(fdnsGeo).ToCuboid()
        srfs = bdBox_fdn.Explode()
        belowSrf = [i for i in srfs if i.NormalAtParameter(0.5,0.5).Z == -1][0]
        def getSrfHeight(srf):
            _crvs = srf.PerimeterCurves()
            heights = [i.StartPoint.Z for i in _crvs]
            height = min(heights)
            return height
        belowSrf_height = getSrfHeight(belowSrf)
        
        def findLeanThk(leanobj):
            if leanobj:
                return leanobj.GetParameterValueByName("thk")
            else:
                return leanThk
        leanobj = None
        leanthk = findLeanThk(leanobj)
        
        def offsetCrv(crv, offset=300):
            return crv.Offset(offset)
        def correctElev(crv, thk):
            return crv.Translate(0,0,thk)
        _exca_belowbdry = offsetCrv(PolyCurve.ByJoinedCurves(belowSrf.PerimeterCurves()), bttmOffset)
        exca_belowbdry = correctElev(_exca_belowbdry, -leanthk)
        _exca_upperbdry = correctElev(_exca_belowbdry, -belowSrf_height)
        exca_upperbdry = offsetCrv(_exca_upperbdry, -belowSrf_height/slopeExcav)
        target = Solid.ByLoft([exca_belowbdry,exca_upperbdry])#excavation_solid
        
        
    else:
        calcTargetNum = 1
        srfs = input.Geometry()[0].Explode()
        belowSrf = [i for i in srfs if i.NormalAtParameter(0.5,0.5).Z == -1][0]
        
        def getSrfHeight(srf):
            _crvs = srf.PerimeterCurves()
            heights = [i.StartPoint.Z for i in _crvs]
            height = min(heights)
            return height
        belowSrf_height = getSrfHeight(belowSrf)
        
        def findLeanThk(leanobj):
            if leanobj:
                return leanobj.GetParameterValueByName("thk")
            else:
                return leanThk
        leanobj = None
        leanthk = findLeanThk(leanobj)
        
        def offsetCrv(crv, offset=300):
            return crv.Offset(offset)
        def correctElev(crv, thk):
            return crv.Translate(0,0,thk)
        _exca_belowbdry = offsetCrv(PolyCurve.ByJoinedCurves(belowSrf.PerimeterCurves()), bttmOffset)
        exca_belowbdry = correctElev(_exca_belowbdry, -leanthk)
        _exca_upperbdry = correctElev(_exca_belowbdry, -belowSrf_height)
        exca_upperbdry = offsetCrv(_exca_upperbdry, -belowSrf_height/slopeExcav)
        target = Solid.ByLoft([exca_belowbdry,exca_upperbdry])#excavation_solid

    return (target, sum([i.Volume for i in [target]])/calcTargetNum/1000000000, "M3")

# Assign your output to the OUT variable.
#OUT = fdnsGeo
OUT = (터파기산출함수,["Footing-Rectangular"],["Excavation"],["M3"])
# ----------------------------------------
되메우기산출함수 = Python(IN[0]=터파기산출함수, IN[1]=온통_터파기_여부)  # CPython3; unwired: IN[2], IN[3], IN[4], IN[5]
# ---------- 되메우기산출함수.python (85 lines) ----------
# Load the Python Standard and DesignScript Libraries
import sys
import clr

clr.AddReference('RevitAPI')
from Autodesk.Revit.DB import *
import Autodesk

clr.AddReference('RevitNodes')
import Revit
clr.ImportExtensions(Revit.Elements)

clr.AddReference('RevitServices')
import RevitServices
from RevitServices.Persistence import DocumentManager
doc = DocumentManager.Instance.CurrentDBDocument
collector1 = FilteredElementCollector(doc)
collector2 = FilteredElementCollector(doc)
collector3 = FilteredElementCollector(doc)
collector4 = FilteredElementCollector(doc)

clr.AddReference('ProtoGeometry')
from Autodesk.DesignScript.Geometry import *

allFdns = collector1.OfCategory(BuiltInCategory.OST_StructuralFoundation).WhereElementIsNotElementType().ToElements()
allCols = collector2.OfCategory(BuiltInCategory.OST_StructuralColumns).WhereElementIsNotElementType().ToElements()
allBeams = collector3.OfCategory(BuiltInCategory.OST_StructuralFraming).WhereElementIsNotElementType().ToElements()
allIsoFdns = [i.ToDSType(False) for i in allFdns if "Footing-" in i.Name]
allPeds = [i.ToDSType(False) for i in allCols if "UG" in i.Name]
allPedsGeo = [i.Geometry()[0] for i in allPeds]
allTGs = [i.ToDSType(False) for i in allBeams if "TG" in i.Name]
allTGsGeo = [i.Geometry()[0] for i in allTGs]

# The inputs to this node will be stored as a list in the IN variables.
dataEnteringNode = IN
refFunc = IN[0][0]
wholeExcavationBln = IN[1]
input = IN[2]
bttmOffset = IN[3]
leanThk = IN[4]
slopeExcav = IN[5]

def careEmpty(i):
    if i:
        return i
    else:
        pass

# Place your code below this line

def 되메우기산출함수(input):
    targets = []
    
    if wholeExcavationBln:
        calcTargetNum = len(allIsoFdns)
        exca_solid = refFunc(input)[0]
        fdn_solid = Solid.ByUnion([i.Geometry()[0] for i in allIsoFdns])
        peds_solid = Solid.ByUnion(allPedsGeo)
        TGs_solid = Solid.ByUnion(allTGsGeo)
        __target = exca_solid.Difference(fdn_solid)
        _target = __target.Difference(peds_solid) ##지중보 형상 미 포함
        target = _target.Difference(TGs_solid)
        pass

    else:
        calcTargetNum = 1
        exca_solid = refFunc(input)[0]
        fdn_solid = input.Geometry()[0]
        _joinedPeds = [i for i in allPedsGeo if i.DoesIntersect(exca_solid)]
        joinedPeds = Solid.ByUnion(_joinedPeds)
        _joinedTGs = [i for i in allTGsGeo if i.DoesIntersect(exca_solid)]
        if len(_joinedTGs)>0:
            joinedTGs = Solid.ByUnion(_joinedTGs)
            __target = exca_solid.Difference(fdn_solid)#Backfill_Solid ##린 콘크리트 형상 미포함
            _target = __target.Difference(joinedPeds)
            target = _target.Difference(joinedTGs)
        else:
            __target = exca_solid.Difference(fdn_solid)
            target = __target.Difference(joinedPeds)

    return (target, sum([i.Volume for i in [target]])/calcTargetNum/1000000000, "M3")

# Assign your output to the OUT variable.
#OUT = getBackfillTarget(input)
OUT = (되메우기산출함수,["Footing-Rectangular"],["Backfill"],["M3"])
# ----------------------------------------
funcs_set = Python(IN[0]=콘크리트물량산출함수, IN[1]=거푸집산출함수, IN[2]=터파기산출함수, IN[3]=되메우기산출함수)  # CPython3
# ---------- funcs_set.python (13 lines) ----------
# Load the Python Standard and DesignScript Libraries
import sys
import clr
clr.AddReference('ProtoGeometry')
from Autodesk.DesignScript.Geometry import *

# The inputs to this node will be stored as a list in the IN variables.
dataEnteringNode = IN

# Place your code below this line

# Assign your output to the OUT variable.
OUT = IN
# ----------------------------------------
getTargetAndValue = Python(IN[0]=createElemDS, IN[1]=funcs_set)  # CPython3
# ---------- getTargetAndValue.python (83 lines) ----------
# Load the Python Standard and DesignScript Libraries
import sys
import clr
clr.AddReference('ProtoGeometry')
from Autodesk.DesignScript.Geometry import *

from itertools import chain

# The inputs to this node will be stored as a list in the IN variables.
dataEnteringNode = IN
elemDSs = IN[0]
funcSets = IN[1]
#func = IN[1][0]
#funcfamilyTag = IN[1][1]
#funcWmTag = IN[1][2]
#funcUnitTag = IN[1][3]
# Place your code below this line


def getTarget(elemDS, funcSets):
    elem = elemDS["elem"]
    etype = elemDS["elemType"]
    familyCode = elemDS["familyCode"]
    wms = elemDS["WMperElem"]
    result = []
    
#    def matchWM_func(wms, funcSet):
#        result = []
#        func = funcSet[0]
#        for wm in wms:
#            tmp1 = []
#            tmp2 = []
#            wmbln = []
#            for i in funcSet[1]:
#                if i in etype:#element type 비교
#                    tmp1.append(True)
#                else:
#                    tmp1.append(False)
#            for i in funcSet[2]:#work type 비교
#                if i in wm:
#                    tmp2.append(True)
#                else:
#                    tmp2.append(False)
#            if any(tmp1) and any(tmp2):
#                result.append([etype, wm, func, func(elem)])
#
#        return result
    
    def matchWM_func(wm, funcSets):
        result = []
        
        for funcSet in funcSets:
            func = funcSet[0]
            tmp1 = []
            tmp2 = []

            for i in funcSet[1]:
                if i in etype:#element type 비교
                    tmp1.append(True)
                else:
                    tmp1.append(False)
            for i in funcSet[2]:#work type 비교
                if i in wm:
                    tmp2.append(True)
                else:
                    tmp2.append(False)
            if any(tmp1) and any(tmp2):
                result.append([etype, wm, func, func(elem)])

        return result

#    result = [matchWM_func(wm, funcSets) for wm in wms]
    result = []
    for wm in wms:
        if matchWM_func(wm, funcSets):
            result.append(matchWM_func(wm, funcSets))
        else:
            result.append([[etype, wm, "!!대응함수 없음!!",["!산출타겟 없음!","!산출값 없음!","!산출단위 없음!"]]])

    return list(chain(*result))

# Assign your output to the OUT variable.
OUT = [getTarget(elemDS, funcSets) for elemDS in elemDSs]
# ----------------------------------------
watch_11 = Watch(getTargetAndValue)
getParameterValueByName_3 = Element.GetParameterValueByName()  # unwired: element, parameterName
code_block_57 = CodeBlock(i=createElemDS) { i["elem"]; }
code_block_58 = CodeBlock(i=code_block_57) { i[0]; }

# group: <Func 3> Disposal (잔토처리 1.2 비율)
watch_12 = Watch(value_for_import_from_others.RefInput1)
토량_환산_계수_2 = DoubleInput(1)  # graph input
code_block_59 = CodeBlock(i=watch_12, 토량환산계수=토량_환산_계수_2) { Math.Round(List.Flatten(i)/1000000000, 2)*토량환산계수; }
code_block_60 = CodeBlock { "M3"; }
count_11 = List.Count(list=watch_12)
ofRepeatedItem_9 = List.OfRepeatedItem(item=code_block_60, amount=count_11)
# note: 잔토처리
code_block_61 = CodeBlock(FuncValues=code_block_59, FuncValuesUnit=ofRepeatedItem_9)  # same code as code_block_7

code_block_62 = CodeBlock(i=getTargetAndValue) { i[0][2][3][0]; }
