# Dynamo graph 0_Dynamo Practice.dyn (Dynamo 2.11.1.4675)

code_block = CodeBlock { 0..100; }
watch = Watch(code_block)
code_block_2 = CodeBlock { 0..100..#11; }
watch_2 = Watch(code_block_2)
byCoordinates = Point.ByCoordinates(x=watch_2, y=watch_2, z=watch_2, lacing=CrossProduct)
code_block_3 = CodeBlock()
# ---------- code_block_3.designscript (5 lines) ----------
[
2000,
2500,
3000
];
# ----------------------------------------
code_block_4 = CodeBlock()  # same code as code_block_3
code_block_5 = CodeBlock()
# ---------- code_block_5.designscript (5 lines) ----------
[
500,
600,
700
];
# ----------------------------------------
code_block_6 = CodeBlock()
# ---------- code_block_6.designscript (5 lines) ----------
[
"AA00232AD-00001",
"AA00232AD-00002",
"AA00232AD-00003"
];
# ----------------------------------------
byLengths = Cuboid.ByLengths(width=code_block_3, length=code_block_4, height=code_block_5)
area = Solid.Area(solid=byLengths)
volume = Solid.Volume(solid=byLengths)
code_block_7 = CodeBlock(width=code_block_3, length=code_block_4, height=code_block_5, material=code_block_6, solid=byLengths, surfaceArea=area, volume=volume)
# ---------- code_block_7.designscript (9 lines) ----------
{
"Width": width,
"Length": length,
"Height": height,
"Material": material,
"Solid": solid,
"SurfaceArea": surfaceArea/1000000,
"Volume": volume/1000000000
};
# ----------------------------------------
watch_3 = Watch(code_block_7)
code_block_8 = CodeBlock { "SurfaceArea"; }
valueAtKey = DesignScript.Builtin.Dictionary.ValueAtKey(dictionary=watch_3, key=code_block_8)
components = DesignScript.Builtin.Dictionary.Components(dictionary=watch_3)
transpose = List.Transpose(lists=components.values)
