# Dynamo graph Str Foundation Calculator_DataStructureTest(0720).dyn (Dynamo 2.10.1.3976)

categories = Categories("OST_StructuralFoundation")
all_elements_of_category = ElementsOfCategory(Category=categories)

# group: Set Up Dictionary <all Element Inform>
# note: Input Node
code_block = CodeBlock(Element=all_elements_of_category) { _Element; }
name = Element.Name(element=code_block)
code_block_2 = CodeBlock { "_"; }
split = String.Split(str=name, separator0=code_block_2)
firstItem = List.FirstItem(list=split@L2)
getLocation = Element.GetLocation()  # unwired: element
map = List.Map(list=code_block, function=getLocation)
# note: Excel Import 로 수정 필요
getMaterials = Element.GetMaterials()  # unwired: element
map_2 = List.Map(list=code_block, function=getMaterials)
name_2 = Element.Name(element=map_2)
code_block_3 = CodeBlock(element=code_block, elementType=name, familyCode=firstItem, location=map, material=map_2, wmCode=name_2)  # unwired: surfaceArea, volume
# ---------- code_block_3.designscript (10 lines) ----------
{
"Element": element,
"ElementType": elementType,
"FamilyCode": familyCode,
"Location": location,
"Material": material,
"WMCode": wmCode ,
"SurfaceArea": surfaceArea/1000000,
"Volume": volume/1000000000
};
# ----------------------------------------

# group: Select Target Family
code_block_4 = CodeBlock(DicIn=code_block_3) { _DicIn; }
code_block_5 = CodeBlock { "FamilyCode"; }
valueAtKey = DesignScript.Builtin.Dictionary.ValueAtKey(dictionary=code_block_4, key=code_block_5)
targetFamily = CodeBlock()
# ---------- targetFamily.designscript (4 lines) ----------
[
"FT21",
"FT11"
];
# ----------------------------------------
contains = String.Contains(str=valueAtKey, searchFor=targetFamily@L1)
code_block_6 = CodeBlock { true; }
allIndicesOf = List.AllIndicesOf(list=contains@L2, item=code_block_6)
code_block_7 = CodeBlock { "Element"; }
valueAtKey_2 = DesignScript.Builtin.Dictionary.ValueAtKey(dictionary=code_block_4, key=code_block_7)
getItemAtIndex = List.GetItemAtIndex(list=valueAtKey_2, index=allIndicesOf)
name_3 = Element.Name(element=getItemAtIndex)
code_block_8 = CodeBlock { "WMCode"; }
valueAtKey_3 = DesignScript.Builtin.Dictionary.ValueAtKey(dictionary=code_block_4, key=code_block_8)
getItemAtIndex_2 = List.GetItemAtIndex(list=valueAtKey_3, index=allIndicesOf)
code_block_9 = CodeBlock(targetFamilyIndex=allIndicesOf, targetFamilyCode=name_3, targetElements=getItemAtIndex, WMforTargetElements=getItemAtIndex_2)
# ---------- code_block_9.designscript (7 lines) ----------
{
//"TargetFamily[]": targetFamily,
"TargetFamilyIndex": targetFamilyIndex,
"TargetFamilyCode": targetFamilyCode,
"TargetElements": targetElements,
"WMforTargetElements": WMforTargetElements
};
# ----------------------------------------

components = DesignScript.Builtin.Dictionary.Components(dictionary=code_block_9)
transpose = List.Transpose(lists=components.values)
watch = Watch(transpose)

# group: func2
extractUpperFacesOfElement = Custom[ExtractUpperFacesOfElement]()  # ExtractUpperFacesOfElement; unwired: Element
area = Surface.Area()  # unwired: surface
sum = Math.Sum()  # unwired: values
function_compose = ComposeFunctions(function0=extractUpperFacesOfElement.in, function1=area, function2=sum)

# group: func1
code_block_10 = CodeBlock { "Volume"; }
getParameterValueByName = Element.GetParameterValueByName(parameterName=code_block_10)  # unwired: element

# group: func3
extractBelowFacesOfElement = Custom[ExtractBelowFacesOfElement]()  # ExtractBelowFacesOfElement; unwired: Element
area_2 = Surface.Area()  # unwired: surface
sum_2 = Math.Sum()  # unwired: values
function_compose_2 = ComposeFunctions(function0=extractBelowFacesOfElement.in, function1=area_2, function2=sum_2)

join = List.Join(list0=function_compose, list1=getParameterValueByName, list2=function_compose_2, list3=function_compose_2, list4=getParameterValueByName)

# group: Select Target WorkMasterCode and Function
code_block_11 = CodeBlock(DicIn=code_block_9) { _DicIn; }
components_2 = DesignScript.Builtin.Dictionary.Components(dictionary=code_block_11)
# note: 패밀리 선택
code_block_12 = CodeBlock { 1; }
getItemAtIndex_3 = List.GetItemAtIndex(list=components_2.values@L4, index=code_block_12)
byKeysValues = DesignScript.Builtin.Dictionary.ByKeysValues(keys=components_2.keys, values=getItemAtIndex_3)
code_block_13 = CodeBlock { "TargetElements"; }
valueAtKey_4 = DesignScript.Builtin.Dictionary.ValueAtKey(dictionary=byKeysValues, key=code_block_13)
code_block_14 = CodeBlock { "TargetFamilyCode"; }
valueAtKey_5 = DesignScript.Builtin.Dictionary.ValueAtKey(dictionary=byKeysValues, key=code_block_14)
code_block_15 = CodeBlock { "WMforTargetElements"; }
valueAtKey_6 = DesignScript.Builtin.Dictionary.ValueAtKey(dictionary=byKeysValues, key=code_block_15)
flatten = List.Flatten(list=valueAtKey_6)
uniqueItems = List.UniqueItems(list=flatten)
code_block_16 = CodeBlock(targetElements=valueAtKey_4, targetFamilyCode=valueAtKey_5, WMforTargetElements=valueAtKey_6, targetWMunique=uniqueItems, targetFunctions=join)
# ---------- code_block_16.designscript (7 lines) ----------
{
"TargetElements": targetElements,
"TargetFamilyCode": targetFamilyCode,
"WMforTargetElements": _WMforTargetElements,
"TargetWMunique": targetWMunique,
"TargetFunctions": targetFunctions
};
# ----------------------------------------
ofRepeatedItem = List.OfRepeatedItem()  # unwired: item, amount
flatten_2 = List.Flatten(list=valueAtKey_4)
count = List.Count(list=valueAtKey_6@L2)
laceShortest = List.LaceShortest(combineFunction=ofRepeatedItem, list0=flatten_2, list1=count)

# group: Calculate Function with Elements
map_3 = List.Map()  # unwired: list, function
code_block_17 = CodeBlock(DicIn=code_block_16) { _DicIn; }
code_block_18 = CodeBlock { "TargetFunctions"; }
valueAtKey_7 = DesignScript.Builtin.Dictionary.ValueAtKey(dictionary=code_block_17, key=code_block_18)
code_block_19 = CodeBlock { "WMforTargetElements"; }
valueAtKey_8 = DesignScript.Builtin.Dictionary.ValueAtKey(dictionary=code_block_17, key=code_block_19)
code_block_20 = CodeBlock { "TargetWMunique"; }
valueAtKey_9 = DesignScript.Builtin.Dictionary.ValueAtKey(dictionary=code_block_17, key=code_block_20)
allIndicesOf_2 = List.AllIndicesOf(list=valueAtKey_8@L2, item=valueAtKey_9)
clean = List.Clean(list=allIndicesOf_2@L1)
count_2 = List.Count(list=valueAtKey_8@L3)
chop = List.Chop(list=clean, lengths=count_2)
getItemAtIndex_4 = List.GetItemAtIndex(list=valueAtKey_7, index=chop)
code_block_21 = CodeBlock { 1; }
flatten_3 = List.Flatten(list=getItemAtIndex_4@L3, amt=code_block_21)
flatten_4 = List.Flatten(list=flatten_3)
flatten_5 = List.Flatten(list=laceShortest)
laceShortest_2 = List.LaceShortest(combineFunction=map_3, list0=flatten_4, list1=flatten_5)

# group: func1
code_block_22 = CodeBlock { "Volume"; }
getParameterValueByName_2 = Element.GetParameterValueByName(parameterName=code_block_22)  # unwired: element

# group: func3
extractBelowFacesOfElement_2 = Custom[ExtractBelowFacesOfElement]()  # unwired: Element
area_3 = Surface.Area()  # unwired: surface
sum_3 = Math.Sum()  # unwired: values
function_compose_3 = ComposeFunctions(function0=extractBelowFacesOfElement_2.in, function1=area_3, function2=sum_3)

# group: func2
extractSideFacesOfElement = Custom[ExtractSideFacesOfElement]()  # ExtractSideFacesOfElement; unwired: Element
area_4 = Surface.Area()  # unwired: surface
sum_4 = Math.Sum()  # unwired: values
function_compose_4 = ComposeFunctions(function0=extractSideFacesOfElement.in, function1=area_4, function2=sum_4)

join_2 = List.Join(list0=function_compose_4)

# group: Select Target WorkMasterCode and Function
code_block_23 = CodeBlock(DicIn=code_block_9) { _DicIn; }
components_3 = DesignScript.Builtin.Dictionary.Components(dictionary=code_block_23)
# note: 패밀리 선택
code_block_24 = CodeBlock { 0; }
getItemAtIndex_5 = List.GetItemAtIndex(list=components_3.values@L4, index=code_block_24)
byKeysValues_2 = DesignScript.Builtin.Dictionary.ByKeysValues(keys=components_3.keys, values=getItemAtIndex_5)
code_block_25 = CodeBlock { "TargetElements"; }
valueAtKey_10 = DesignScript.Builtin.Dictionary.ValueAtKey(dictionary=byKeysValues_2, key=code_block_25)
code_block_26 = CodeBlock { "TargetFamilyCode"; }
valueAtKey_11 = DesignScript.Builtin.Dictionary.ValueAtKey(dictionary=byKeysValues_2, key=code_block_26)
code_block_27 = CodeBlock { "WMforTargetElements"; }
valueAtKey_12 = DesignScript.Builtin.Dictionary.ValueAtKey(dictionary=byKeysValues_2, key=code_block_27)
flatten_6 = List.Flatten(list=valueAtKey_12)
uniqueItems_2 = List.UniqueItems(list=flatten_6)
code_block_28 = CodeBlock(targetElements=valueAtKey_10, targetFamilyCode=valueAtKey_11, WMforTargetElements=valueAtKey_12, targetWMunique=uniqueItems_2, targetFunctions=join_2)  # same code as code_block_16
ofRepeatedItem_2 = List.OfRepeatedItem()  # unwired: item, amount
flatten_7 = List.Flatten(list=valueAtKey_10)
count_3 = List.Count(list=valueAtKey_12@L2)
laceShortest_3 = List.LaceShortest(combineFunction=ofRepeatedItem_2, list0=flatten_7, list1=count_3)

# group: Calculate Function with Elements
map_4 = List.Map()  # unwired: list, function
code_block_29 = CodeBlock(DicIn=code_block_28) { _DicIn; }
code_block_30 = CodeBlock { "TargetFunctions"; }
valueAtKey_13 = DesignScript.Builtin.Dictionary.ValueAtKey(dictionary=code_block_29, key=code_block_30)
code_block_31 = CodeBlock { "WMforTargetElements"; }
valueAtKey_14 = DesignScript.Builtin.Dictionary.ValueAtKey(dictionary=code_block_29, key=code_block_31)
code_block_32 = CodeBlock { "TargetWMunique"; }
valueAtKey_15 = DesignScript.Builtin.Dictionary.ValueAtKey(dictionary=code_block_29, key=code_block_32)
allIndicesOf_3 = List.AllIndicesOf(list=valueAtKey_14@L2, item=valueAtKey_15)
clean_2 = List.Clean(list=allIndicesOf_3@L1)
count_4 = List.Count(list=valueAtKey_14@L3)
chop_2 = List.Chop(list=clean_2, lengths=count_4)
getItemAtIndex_6 = List.GetItemAtIndex(list=valueAtKey_13, index=chop_2)
code_block_33 = CodeBlock { 1; }
flatten_8 = List.Flatten(list=getItemAtIndex_6@L3, amt=code_block_33)
flatten_9 = List.Flatten(list=flatten_8)
flatten_10 = List.Flatten(list=laceShortest_3)
laceShortest_4 = List.LaceShortest(combineFunction=map_4, list0=flatten_9, list1=flatten_10)
